# Grasshopper definition site_reconstruction.gh (Grasshopper 1.0.7)
# plug-ins: Volvox, Telepathy, ProvingGround.Slingshot, Human, Pufferfish, LunchBox, Firefly.X, Heteroptera, Owl.GH, Owl.Accord.GH

# ----
# Setup DB Connection
python = GhPythonScript()  # -> path
# ---------- python: Python ----------
__author__ = "mattj"
__version__ = "2021.01.27"

import rhinoscriptsyntax as rs

import Grasshopper

import os

full_path = Grasshopper.Instances.ActiveCanvas.Document.FilePath
dir = os.path.dirname(full_path)

path = dir + os.path.sep + "connection.txt"
# ---------- end python ----------
file = ReadFile(File=python, PerLineParse=True)
cstring = ConnectionString(
    CommandTimeout="20",
    ConnectionTimeout="5",
    Connector="MySQL",
    Database="{3}",
    Password="{2}",
    Port="3306",
    Server="{0}",
    UserID="{1}")
item = ListItem(List=file, Index=0, Wrap=True)  # -> Item, Item1, Item2, Item3
format = Format(Format=cstring, Culture=127, Data0=item.Item, Data1=item.Item1, Data2=item.Item2, Data3=item.Item3)
text_cstring = RemoteSender(format)

panel = Panel("scaled_workshop")

# ----
# Fetch Site UUID
panel_2 = Panel("name='{0}'")
format_2 = Format(Format=panel_2, Culture=127, Data0="iaac_atelier_photogrammetry")
querysfw = SQLSELECTString(Select="bin_to_uuid(uuid)", From="sites", Where=format_2, Connector="MySQL")
text_cstring_2 = RemoteReceiver(text_cstring)
query = RDBMSQuery(ConnectString=text_cstring_2, ConnectToggle=Toggle(True), RDBMSQuery=querysfw, Connector="MySQL")  # -> Exceptions, TableHeadings, TableData
str_site_uuid = RemoteSender(query.TableData)

button = Button()
path = FilePath(["C:\Users\mattj\Documents\iaac\thesis\modules\site_reconstruction\pipeline\crue_de_molers_10\2_plane_merged\planes_009\0.e57", "C:\Users\mattj\Documents\iaac\thesis\modules\site_reconstruction\pipeline\crue_de_molers_10\2_plane_merged\planes_009\1.e57", "C:\Users\mattj\Documents\iaac\thesis\modules\site_reconstruction\pipeline\crue_de_molers_10\2_plane_merged\planes_009\2.e57", "C:\Users\mattj\Documents\iaac\thesis\modules\site_reconstruction\pipeline\crue_de_molers_10\2_plane_merged\planes_009\3.e57", "C:\Users\mattj\Documents\iaac\thesis\modules\site_reconstruction\pipeline\crue_de_molers_10\2_plane_merged\planes_009\4.e57", "C:\Users\mattj\Documents\iaac\thesis\modules\site_reconstruction\pipeline\crue_de_molers_10\2_plane_merged\planes_009\5.e57"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])
loade57 = LoadE57(FilePath=path, Index=-1, Percent=1, Run=Toggle(True), Abort=False, Check=False)  # -> Cloud, Pose
clo = Cloud(flatten(loade57.Cloud))

# ---- group: Load Clouds
# RANSAC CYLINDERS
# Load Cylinder Clouds
panel_3 = Panel("x y z r g b nx ny nz")
path_2 = FilePath(["C:\Users\mattj\Documents\iaac\thesis\modules\site_reconstruction\tests\crue_de_molers_10\split_clouds\cylinders_009\converted\cylinders_009_000000.txt", "C:\Users\mattj\Documents\iaac\thesis\modules\site_reconstruction\tests\crue_de_molers_10\split_clouds\cylinders_009\converted\cylinders_009_000001.txt", "C:\Users\mattj\Documents\iaac\thesis\modules\site_reconstruction\tests\crue_de_molers_10\split_clouds\cylinders_009\converted\cylinders_009_000002.txt", "C:\Users\mattj\Documents\iaac\thesis\modules\site_reconstruction\tests\crue_de_molers_10\split_clouds\cylinders_009\converted\cylinders_009_000003.txt", "C:\Users\mattj\Documents\iaac\thesis\modules\site_reconstruction\tests\crue_de_molers_10\split_clouds\cylinders_009\converted\cylinders_009_000004.txt", "C:\Users\mattj\Documents\iaac\thesis\modules\site_reconstruction\tests\crue_de_molers_10\split_clouds\cylinders_009\converted\cylinders_009_000005.txt"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])
xyzload = LoadXyz(FilePath=path_2, Mask=panel_3, Percent=1)
abort = Button()
run = Button()
rsub = RandomSubsampling(Percent="0.05", Seed=123)
cloudx = CloudEngineX(Cloud=xyzload, Run=run, Abort=abort, Instruction0=rsub, showinfo=True)

# ----
number_slider = Slider(2, range=0..20)
path_3 = FilePath(["C:\Users\mattj\Documents\iaac\thesis\modules\site_reconstruction\iaac_photogrammetry\camera\ex_2021_3_22-15_56_29.csv", "C:\Users\mattj\Documents\iaac\thesis\modules\site_reconstruction\iaac_photogrammetry\camera\ex_2021_3_22-15_57_6.csv", "C:\Users\mattj\Documents\iaac\thesis\modules\site_reconstruction\iaac_photogrammetry\camera\ex_2021_3_22-15_57_22.csv", "C:\Users\mattj\Documents\iaac\thesis\modules\site_reconstruction\iaac_photogrammetry\camera\ex_2021_3_22-15_57_33.csv", "C:\Users\mattj\Documents\iaac\thesis\modules\site_reconstruction\iaac_photogrammetry\camera\ex_2021_3_22-15_57_41.csv", "C:\Users\mattj\Documents\iaac\thesis\modules\site_reconstruction\iaac_photogrammetry\camera\ex_2021_3_22-15_57_49.csv", "C:\Users\mattj\Documents\iaac\thesis\modules\site_reconstruction\iaac_photogrammetry\camera\ex_2021_3_22-15_58_8.csv"])
path_4 = FilePath(["C:\Users\mattj\Documents\iaac\thesis\modules\site_reconstruction\iaac_photogrammetry\camera\in_2021_3_22-15_56_29.csv", "C:\Users\mattj\Documents\iaac\thesis\modules\site_reconstruction\iaac_photogrammetry\camera\in_2021_3_22-15_57_6.csv", "C:\Users\mattj\Documents\iaac\thesis\modules\site_reconstruction\iaac_photogrammetry\camera\in_2021_3_22-15_57_22.csv", "C:\Users\mattj\Documents\iaac\thesis\modules\site_reconstruction\iaac_photogrammetry\camera\in_2021_3_22-15_57_33.csv", "C:\Users\mattj\Documents\iaac\thesis\modules\site_reconstruction\iaac_photogrammetry\camera\in_2021_3_22-15_57_41.csv", "C:\Users\mattj\Documents\iaac\thesis\modules\site_reconstruction\iaac_photogrammetry\camera\in_2021_3_22-15_57_49.csv", "C:\Users\mattj\Documents\iaac\thesis\modules\site_reconstruction\iaac_photogrammetry\camera\in_2021_3_22-15_58_8.csv"])
path_5 = FilePath(["C:\Users\mattj\Documents\iaac\thesis\modules\site_reconstruction\iaac_photogrammetry\cloud_renders_small\2021_3_22-15_56_29-3.png", "C:\Users\mattj\Documents\iaac\thesis\modules\site_reconstruction\iaac_photogrammetry\cloud_renders_small\2021_3_22-15_57_6-3.png", "C:\Users\mattj\Documents\iaac\thesis\modules\site_reconstruction\iaac_photogrammetry\cloud_renders_small\2021_3_22-15_57_22-3.png", "C:\Users\mattj\Documents\iaac\thesis\modules\site_reconstruction\iaac_photogrammetry\cloud_renders_small\2021_3_22-15_57_33-3.png", "C:\Users\mattj\Documents\iaac\thesis\modules\site_reconstruction\iaac_photogrammetry\cloud_renders_small\2021_3_22-15_57_41-3.png", "C:\Users\mattj\Documents\iaac\thesis\modules\site_reconstruction\iaac_photogrammetry\cloud_renders_small\2021_3_22-15_57_49-3.png", "C:\Users\mattj\Documents\iaac\thesis\modules\site_reconstruction\iaac_photogrammetry\cloud_renders_small\2021_3_22-15_58_8-3.png"])
item_2 = ListItem(List=path_3, Index=number_slider, Wrap="0")
item_3 = ListItem(List=path_4, Index=number_slider, Wrap="0")
item_4 = ListItem(List=path_5, Index=number_slider, Wrap="0")
current_extrinsic = RemoteSender(item_2)
current_intrinsic = RemoteSender(item_3)
current_image = RemoteSender(item_4)

dpipeline = DynamicGeometryPipeline(
    LayerFilter="Layer 01",
    TypeFilter="mesh",
    NameFilter="*",
    GroupByLayer=False,
    GroupByType=False,
    IncludeHidden=True,
    IncludeLocked=True,
    enableFullPath=False,
    listenToAttributes=True)

trigger = Trigger(Interval=10000, TimerInterval=10000, Target=python_5)  # disabled
# RAYTRACE SYSTEM
panel_4 = Panel("True")

# ---- group: Extract Legitamate Columns
mesh = Mesh(dpipeline)
clo_2 = Cloud(cloudx)
bbox = BoundingBox(Content=mesh, Plane=PlaneXY(0, 0, 0))  # -> Box, Box_2
number_slider_2 = Slider(3, range=0..10)
boxprop = BoxProperties(Box=bbox.Box)  # -> Center, Diagonal, Area, Volume, Degeneracy
devec = DeconstructVector(Vector=boxprop.Diagonal)  # -> XComponent, YComponent, ZComponent
larger = LargerThan(FirstNumber=devec.ZComponent, SecondNumber=devec.XComponent)  # -> LargerThan, OrEqualTo
larger_2 = LargerThan(FirstNumber=devec.ZComponent, SecondNumber=devec.YComponent)  # -> LargerThan, OrEqualTo
smaller = SmallerThan(FirstNumber=devec.XComponent, SecondNumber=number_slider_2)  # -> SmallerThan, OrEqualTo
smaller_2 = SmallerThan(FirstNumber=devec.YComponent, SecondNumber=number_slider_2)  # -> SmallerThan, OrEqualTo
and = GateAnd(A=larger.LargerThan, B=larger_2.LargerThan)
and_2 = GateAnd(A=smaller.SmallerThan, B=smaller_2.SmallerThan)
and_3 = GateAnd(A=and, B=and_2)
dispatch = Dispatch(List=clo_2, DispatchPattern=and_3)  # -> ListA, ListB
dispatch_2 = Dispatch(List=mesh, DispatchPattern=and_3)  # -> ListA, ListB
dispatch_3 = Dispatch(List=bbox.Box, DispatchPattern=and_3)  # -> ListA, ListB
clo_3 = Cloud(dispatch.ListA)
mesh_2 = Mesh(dispatch_2.ListA)
box = Box(dispatch_3.ListA)

# ----
current_extrinsic_2 = RemoteReceiver(current_extrinsic)
current_image_2 = RemoteReceiver(current_image)
split = TextSplit(Text=current_image_2, Separators="\")
item_5 = ListItem(List=split, Index=0, Wrap=True)  # -> Item1, Item

# ---- group: Save Mapped Image
panel_5 = Panel("test.png")
python_2 = GhPythonScript()  # -> path
# ---------- python_2: Python ----------
__author__ = "mattj"
__version__ = "2021.01.27"

import rhinoscriptsyntax as rs

import Grasshopper

import os

full_path = Grasshopper.Instances.ActiveCanvas.Document.FilePath
dir = os.path.dirname(full_path)

path = dir + os.path.sep + "mapped_images" + os.path.sep
# ---------- end python_2 ----------
concat = Concatenate(FragmentA=python_2, FragmentB=item_5.Item1)
saveview = SaveViewportToFile(Run=Button(), Render=False, FilePath=concat, ScaleFactor=1)

# ----
panel_6 = Panel(item_5.Item1)

# ---- group: Add Rejected Cylinders to Plane Processing
clo_4 = Cloud(dispatch.ListB)
cld_non_cylinders = RemoteSender(clo_4)

# ----
cld_non_cylinders_2 = RemoteReceiver(cld_non_cylinders)

# ---- group: Merge Overlapping Columns
boxprop_2 = BoxProperties(Box=box)  # -> Center, Diagonal, Area, Volume, Degeneracy
project = Project(Geometry=boxprop_2.Center, Plane=PlaneXY(0, 0, 0))  # -> Geometry, Transform
python_3 = GhPythonScript(input=project.Geometry)  # -> out, groups, id_groups; inputs input: list of Point3d
# ---------- python_3: Python ----------
import ghpythonlib.components as gh
import ghpythonlib.treehelpers as tr

groups = [[]]
id_groups = [[]]


for point_id,point in enumerate(input):
    if len(groups[-1]) == 0 and len(groups) == 1:
        groups[-1].append(point)
        id_groups[-1].append(point_id)
        continue

    flag = False
        
    for i in range(len(groups)):
        if gh.Distance(point,groups[i][0]) < 0.5:
            groups[i].append(point)
            id_groups[i].append(point_id)
            flag = True
            continue
    if flag == False:
        groups.append([])
        groups[-1].append(point)
        
        id_groups.append([])
        id_groups[-1].append(point_id)
        
groups = tr.list_to_tree(groups,source = [])

id_groups = tr.list_to_tree(id_groups,source = [])
# ---------- end python_3 ----------
item_6 = ListItem(List=clo_3, Index=python_3.id_groups, Wrap=True)
mcloud = MergeClouds(Cloud=item_6)
clo_5 = Cloud(mcloud)

# ---- group: Extract Saved Ransac Dimensions
objatts = ObjectAttributes(ObjectOrAttributes=mesh_2)  # -> Name, LayerName, LayerFullPath, Color, MaterialName, LinetypeName, GroupIndices, PlotWeight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
panel_7 = Panel(objatts.Name)
python_4 = GhPythonScript(input=objatts.Name)  # -> out, out_r, out_h; inputs input: list
# ---------- python_4: Python ----------
__author__ = "mattj"
__version__ = "2021.03.21"

import rhinoscriptsyntax as rs

out_r = []
out_h = []

for s in input:
    s = s[10:-1]
    parts = s.split("/")
    
    out_r.append(float(parts[0][2:]))
    out_h.append(float(parts[1][2:]))
# ---------- end python_4 ----------
item_7 = ListItem(List=python_4.out_r, Index=python_3.id_groups, Wrap=True)
item_8 = ListItem(List=python_4.out_h, Index=python_3.id_groups, Wrap=True)
avr = Average(Input=item_7)  # -> flatten(ArithmeticMean)
avr_2 = Average(Input=item_8)

# ---- group: Create Camera Matrices
current_extrinsic_3 = RemoteReceiver(current_extrinsic)
current_intrinsic_2 = RemoteReceiver(current_intrinsic)
path_6 = FilePath(current_extrinsic_3)
path_7 = FilePath(current_intrinsic_2)
file_2 = ReadFile(File=path_6, PerLineParse=True)
file_3 = ReadFile(File=path_7, PerLineParse=True)
ins = InsertItems(List=file_2, Item="a,b,c,d", Indices="0", Wrap=True)
ins_2 = InsertItems(List=file_3, Item="a,b,c", Indices="0", Wrap=True)
csv = ReadCSV(CSVString=ins, Delimiter=",")  # -> Headers, Values
csv_2 = ReadCSV(CSVString=ins_2, Delimiter=",")  # -> Headers, Values
flip = FlipMatrix(Data=csv.Values)
flip_2 = FlipMatrix(Data=csv_2.Values)
matrix = ConstructMatrix(Rows="4", Columns="4", Values=flatten(flip))
matrix_2 = ConstructMatrix(Rows="3", Columns="3", Values=flatten(flip_2))
matrix_3 = DisplayMatrix(matrix)
matrix_4 = DisplayMatrix(matrix_2)

# ----
average = Average(Cloud=clo_5, Percent=1)  # -> simplify(Point)
bbox_2 = BoundingBox(Content=clo_5, Plane=PlaneXY(0, 0, 0), UnionBox=True)  # -> Box, Box_2
decloud = DeconstructCloud(Cloud=clo_5)  # -> simplify(Points), Normals, Colors
box_2 = EvaluateBox(Box=bbox_2.Box, UParameter=0.5, VParameter=0.5, WParameter="0")  # -> Plane, Point, Include
project_2 = Project(Geometry=average, Plane=PlaneXY(0, 0, 0))  # -> Geometry, Transform
project_3 = Project(Geometry=decloud.Points, Plane=box_2.Plane)  # -> Geometry, Transform
fcircle = CircleFit(Points=project_3.Geometry)  # -> flatten(Circle), flatten(Radius), Deviation
dist = Distance(PointA=project_3.Geometry, PointB=project_2.Geometry)
avr_3 = Average(Input=dist)  # -> flatten(ArithmeticMean)
debox = DeconstructBox(Box=bbox_2.Box)  # -> Plane, X, Y, Z
eval = Evaluate(x_2="x * 2", x=fcircle.Radius)
dedomain = DeconstructDomain(Domain=debox.Z)  # -> Start, End
subtraction = Subtraction(A=dedomain.End, B=dedomain.Start)
clean = CleanTree(RemoveNulls=True, RemoveInvalid=True, RemoveEmpty=False, Tree=eval)
num_cylinder_diameter = RemoteSender(clean)
num_cylinder_height = RemoteSender(subtraction)
pt_cylinder_center = RemoteSender(fcircle.Circle)

# ---- group: Compare Radius
ransac = Panel(avr)
avg_dist = Panel(avr_3)
circle_fit = Panel(fcircle.Radius)

# ---- group: Combine Column Inputs
pt_cylinder_center_2 = RemoteReceiver(pt_cylinder_center)
num_cylinder_diameter_2 = RemoteReceiver(num_cylinder_diameter)
num_cylinder_height_2 = RemoteReceiver(num_cylinder_height)
pln = Plane(pt_cylinder_center_2)
pt = Point(pln)
cyl = Cylinder(Base=pt, Radius=expr("x / 2", num_cylinder_diameter_2), Length=flatten(num_cylinder_height_2))
srf_cylinders_for_projections = RemoteSender(cyl)

# ----
srf_cylinders_for_projections_2 = RemoteReceiver(srf_cylinders_for_projections)
item_9 = ListItem(List=srf_cylinders_for_projections_2, Index="1", Wrap=True)

# ---- group: Scale to best texture size
bbox_3 = BoundingBox(Content=item_9, Plane=PlaneXY(0, 0, 0))  # -> Box, Box_2
boxprop_3 = BoxProperties(Box=bbox_3.Box)  # -> Center, Diagonal, Area, Volume, Degeneracy
debox_2 = DeconstructBox(Box=bbox_3.Box)  # -> Plane, X, Y, Z
devec_2 = DeconstructVector(Vector=boxprop_3.Diagonal)  # -> XComponent, YComponent, ZComponent
pi = Pi(Factor=1)
multiplication = Multiplication(A=devec_2.XComponent, B=pi)
division = Division(A=devec_2.ZComponent, B=multiplication)
clo_6 = Cloud(flatten(Tree({0;0;0;0}: [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], {0;0;0;0;0}: [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])))
clo_exture = Cloud([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])
clo_local = Cloud([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])
clo_7 = Cloud([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])
mcloud_2 = MergeClouds(Cloud=clo_local)
scale_nu = ScaleNU(Geometry=mcloud_2, Plane=PlaneXY(0, 0, 0), ScaleX=1, ScaleY=division, ScaleZ=1)  # -> Geometry, Transform
clo_8 = Cloud(scale_nu.Geometry)

# ----
cluster = Cluster()

# ----
# ELEMENT MERGING
genes = GenePool(Decimals=2, Maximum=10, Minimum=-10, Value=[4.45, 0.62, 2, -0.78, -3.55, 1.21, -0.34, -0.31, 1.65, -0.23, 5.01, 1.09])
panel_8 = Panel("""0
0
0
1""")
ins_3 = InsertItems(List=genes, Item=panel_8, Indices="-1", Wrap=True)
matrix_5 = ConstructMatrix(Rows="4", Columns="4", Values=ins_3)
matrix_6 = DisplayMatrix(matrix_5)

num = Number("3")
Y = UnitY(Factor=1)
number_slider_3 = Slider(0.5, range=0.5..3)
number_slider_4 = Slider(0.8, range=0.5..3)
xy = XYPlane(Origin=Point(0, 0, 0))
X = UnitX(Factor=1)
number_slider_5 = Slider(1, range=0.5..3)
number_slider_6 = Slider(1, range=0.5..3)
number_slider_7 = Slider(10, range=2..20)
galapagos = Galapagos(fitness=num_3, gene=genes)

pt_cylinder_center_3 = RemoteReceiver(pt_cylinder_center)
deplane = DeconstructPlane(Plane=pt_cylinder_center_3)  # -> Origin, XAxis, YAxis, ZAxis
pdecon = Deconstruct(Point=pt_cylinder_center_3)  # -> XComponent, YComponent, ZComponent
num_cylinder_diameter_3 = RemoteReceiver(num_cylinder_diameter)
lng = ListLength(List=pt_cylinder_center_3)
num_cylinder_height_3 = RemoteReceiver(num_cylinder_height)
repeat = RepeatData(Data="0", Length=lng)
repeat_2 = RepeatData(Data="column_round", Length=lng)
str_site_uuid_2 = RemoteReceiver(str_site_uuid)
merge = Merge(
    Data1=simplify(graft(repeat_2)),
    Data2=simplify(graft(pdecon.XComponent)),
    Data3=simplify(graft(pdecon.YComponent)),
    Data4=simplify(graft(pdecon.ZComponent)),
    Data5=simplify(graft(num_cylinder_diameter_3)),
    Data6=simplify(graft(num_cylinder_diameter_3)),
    Data7=simplify(graft(num_cylinder_height_3)),
    Data8=simplify(graft(repeat)))
format_3 = Format(Format="uuid_to_bin('{0}')", Culture=127, Data0=str_site_uuid_2)
lng_2 = ListLength(List=pt_cylinder_center_3)
format_4 = Format(Format="'{0}'", Culture=127, Data0=merge)
null = NullItem(Item=lng_2)  # -> NullFlags, InvalidFlags, Description
ins_4 = InsertItems(List=format_4, Item=graft(format_3), Indices="0", Wrap=True)  # -> simplify(List)
ins_5 = InsertItems(List=ins_4, Item=graft("uuid_to_bin(uuid())"), Indices="0", Wrap=True)  # -> simplify(List)
join = TextJoin(Text=ins_5, Join=",")  # -> flatten(Result)
gate = StreamGate(Stream=join, Gate=null.NullFlags)  # -> Target0, Target1

# ----
# Load Plane Clouds
panel_9 = Panel("x y z r g b u v w")
path_8 = FilePath(["C:\Users\mattj\Documents\iaac\thesis\modules\site_reconstruction\tests\crue_de_molers_10\split_clouds\planes_009\converted\planes_009_000000.txt", "C:\Users\mattj\Documents\iaac\thesis\modules\site_reconstruction\tests\crue_de_molers_10\split_clouds\planes_009\converted\planes_009_000001.txt", "C:\Users\mattj\Documents\iaac\thesis\modules\site_reconstruction\tests\crue_de_molers_10\split_clouds\planes_009\converted\planes_009_000002.txt", "C:\Users\mattj\Documents\iaac\thesis\modules\site_reconstruction\tests\crue_de_molers_10\split_clouds\planes_009\converted\planes_009_000003.txt", "C:\Users\mattj\Documents\iaac\thesis\modules\site_reconstruction\tests\crue_de_molers_10\split_clouds\planes_009\converted\planes_009_000004.txt", "C:\Users\mattj\Documents\iaac\thesis\modules\site_reconstruction\tests\crue_de_molers_10\split_clouds\planes_009\converted\planes_009_000005.txt"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])
xyzload_2 = LoadXyz(FilePath=path_8, Mask=panel_9, Percent=1)
abort_2 = Button()
run_2 = Button()
rsub_2 = RandomSubsampling(Percent="0.05", Seed=123)
cloudx_2 = CloudEngineX(Cloud=xyzload_2, Run=run_2, Abort=abort_2, Instruction0=rsub_2, showinfo=True)

merge_2 = Merge(Data1=cloudx_2, Data2=cld_non_cylinders_2)  # -> flatten(Result)

decloud_2 = DeconstructCloud(Cloud=merge_2)  # -> Points, Normals, Colors
cld_clouds = RemoteSender(merge_2)
cloud_normals = RemoteSender(decloud_2.Normals)
pt_cloud_points = RemoteSender(decloud_2.Points)

cloud_colors = RemoteSender(decloud_2.Colors)

# ----
# Get Aligned Planes
# Experienced a lot of trouble trying to get a consensus from every edge, mostly due to angle wraparound.
# For now we simply take the longest edge.
cld_clouds_2 = RemoteReceiver(cld_clouds)
pt_exploded_clouds = Point(decloud_2.Points)
clo_input_clouds = Cloud(merge_2)
plfit = PlaneFit(Points=pt_exploded_clouds)  # -> Plane, Deviation
average_2 = Average(Cloud=cld_clouds_2, Percent=1)
number_slider_8 = Slider(10, range=0..10)
pi_2 = Pi(Factor="0.25")

pl_origin = PlaneOrigin(Base=plfit.Plane, Origin=graft(average_2))

pln_fit_plane = Plane(pl_origin)
hull = ConvexHull(Points=pt_exploded_clouds, Plane=pln_fit_plane)  # -> Hull, HullZ, Indices
orient = Orient(Geometry=graft(clo_input_clouds), Source=pln_fit_plane, Target=PlaneXY(0, 0, 0))  # -> Geometry, Transform
orient_2 = Orient(Geometry=hull.Hull, Source=pln_fit_plane, Target=PlaneXY(0, 0, 0))  # -> Geometry, Transform
area = Area(Geometry=orient_2.Geometry)  # -> Area, Centroid
neg = Negative(Value=area.Centroid)
move = Move(Geometry=orient.Geometry, Motion=neg)  # -> Geometry, Transform
move_2 = Move(Geometry=orient_2.Geometry, Motion=neg)  # -> Geometry, Transform
simplify = SimplifyCurve(Curve=move_2.Geometry, Tolerance=Slider(0.292, range=0..1), AngleTolerance="10")  # -> Curve, Simplified
explode = Explode(Curve=simplify.Curve, Recursive=True)  # -> Segments, Vertices
len = Length(Curve=explode.Segments)
sort = SortList(Keys=len, ValuesA=explode.Segments)  # -> Keys, reverse(simplify(ValuesA))
end = EndPoints(Curve=sort.ValuesA)  # -> Start, End
vec2pt = Vector2Pt(PointA=end.Start, PointB=end.End, Unitize=False)  # -> Vector, Length
devec_3 = DeconstructVector(Vector=vec2pt.Vector)  # -> XComponent, YComponent, ZComponent
expression = Expression(x=devec_3.XComponent, y=devec_3.YComponent, Expression="(atan2(y,x) + (PI * 8) ) % (PI /2)")
expression_2 = Expression(x=devec_3.XComponent, y=devec_3.YComponent, Expression="atan2(y,x)")
len_2 = Length(Curve=sort.ValuesA)
bnd = Bounds(Numbers=len_2)
remap = RemapNumbers(Value=len_2, Source=bnd, Target="0.1 to 1")  # -> Mapped, Clipped
split_2 = SplitList(List=expression_2, Index="1")  # -> ListA, ListB
split_3 = SplitList(List=vec2pt.Vector, Index="1")  # -> ListA, ListB
pow = Power(A=remap.Mapped, B=Slider(1, range=1..5))
subtraction_2 = Subtraction(A=split_2.ListA, B=split_2.ListB)
mod = Modulus(A=subtraction_2, B=pi_2)
addition = Addition(A=split_2.ListA, B=mod)
ins_6 = InsertItems(List=addition, Item=split_2.ListA, Indices="0", Wrap=True)
cos = Cosine(Value=ins_6)
ma = MassAddition(Input=split_3.ListA)  # -> Result, PartialResults
sin = Sine(Value=ins_6)
vec = VectorXYZ(XComponent=cos, YComponent=sin, ZComponent=0)  # -> Vector, Length
pln_fit_plane_2 = Plane(pln_fit_plane)
vec_2 = Vector(ma.Result)
multiplication_2 = Multiplication(A=vec.Vector, B=pow)

# ---- group: Select Single Plane for Testing
branch = TreeBranch(Tree=simplify(pt_exploded_clouds), Path=number_slider_8, MaintainPaths=True)
branch_2 = TreeBranch(Tree=simplify(pln_fit_plane), Path=number_slider_8, MaintainPaths=True)

# ---- group: Vector Debug Vis
vdisex = VectorDisplayEx(Point=end.Start, Vector=multiplication_2, Colour="255,0,0", Width=2)
vdis = VectorDisplay(Anchor=end.Start, Vector=multiplication_2)
vdisex_2 = VectorDisplayEx(Point=end.Start, Vector=ma.Result, Colour="0,0,255", Width=2)
vdis_2 = VectorDisplay(Anchor=end.Start, Vector=ma.Result)

# ---- group: Make sure flat planes point Z Up
orient_3 = Orient(Geometry=vec_2, Source=PlaneXY(0, 0, 0), Target=pln_fit_plane_2)  # -> Geometry, Transform
align = AlignPlane(Plane=pln_fit_plane_2, Direction=orient_3.Geometry)  # -> Plane, Angle
deplane_2 = DeconstructPlane(Plane=align.Plane)  # -> Origin, XAxis, YAxis, ZAxis
devec_4 = DeconstructVector(Vector=deplane_2.ZAxis)  # -> XComponent, YComponent, ZComponent
smaller_3 = SmallerThan(FirstNumber=devec_4.ZComponent, SecondNumber="0")  # -> SmallerThan, OrEqualTo
dispatch_4 = Dispatch(List=align.Plane, DispatchPattern=smaller_3.SmallerThan)  # -> ListA, ListB
flippln = FlipPlane(Plane=dispatch_4.ListA, FlipX=False, FlipY=False, FlipZ=True)  # -> Flipped, R
clean_2 = CleanTree(RemoveNulls=True, RemoveInvalid=True, RemoveEmpty=False, Tree=flippln.Flipped)
merge_3 = Merge(Data1=clean_2, Data2=dispatch_4.ListB)
pln_aligned_planes = Plane(merge_3)

# ---- group: Align Vertical Planes to True Up
pln_aligned_planes_2 = Plane(pln_aligned_planes)
deplane_3 = DeconstructPlane(Plane=pln_aligned_planes_2)  # -> Origin, XAxis, YAxis, ZAxis
devec_5 = DeconstructVector(Vector=deplane_3.ZAxis)  # -> XComponent, YComponent, ZComponent
abs = Absolute(Value=devec_5.XComponent)
abs_2 = Absolute(Value=devec_5.YComponent)
abs_3 = Absolute(Value=devec_5.ZComponent)
larger_3 = LargerThan(FirstNumber=abs_3, SecondNumber=abs)  # -> LargerThan, OrEqualTo
larger_4 = LargerThan(FirstNumber=abs_3, SecondNumber=abs_2)  # -> LargerThan, OrEqualTo
and_4 = GateAnd(A=larger_3.LargerThan, B=larger_4.LargerThan)
dispatch_5 = Dispatch(List=pln_aligned_planes_2, DispatchPattern=and_4)  # -> ListA, ListB
Z = UnitZ(Factor=1)
align_2 = AlignPlane(Plane=dispatch_5.ListB, Direction=Z)  # -> Plane, Angle
pi_3 = Pi(Factor="-0.5")
not = GateNot(A=and_4)
prot = RotatePlane(Plane=align_2.Plane, Angle=pi_3)
bool_is_horizontal = Boolean(and_4)
weave = Weave(Pattern=flatten(not), Stream0=flatten(dispatch_5.ListA), Stream1=flatten(prot), NullGaps=False)

# ----
srf_cylinders_for_projections_3 = RemoteReceiver(srf_cylinders_for_projections)

current_image_3 = RemoteReceiver(current_image)
path_9 = FilePath("C:\Users\mattj\Documents\iaac\thesis\modules\site_reconstruction\mapped_images\2021_3_22-15_57_22-3.png")
path_10 = FilePath(current_image_3)
load_bitmap = LoadBitmap(FilePathToImageLocation=path_10)
load_bitmap_2 = LoadBitmap(FilePathToImageLocation=path_9)
eventtoggle = EventSwitch(Boolean=Button())
decompose = BitmapDecompose(BitmapToDecompose=load_bitmap_2)  # -> RedChannel, GreenChannel, BlueChannel, AlphaChannel, XResolution, YResolution
decompose_2 = BitmapDecompose(BitmapToDecompose=load_bitmap)  # -> RedChannel, GreenChannel, BlueChannel, AlphaChannel, XResolution, YResolution
can = OilCan(DataList="1", Reset=False, Drop=eventtoggle, DropMode=0)
rgb = ColourRGB(Alpha=255, Red=decompose_2.RedChannel, Green=decompose_2.GreenChannel, Blue=decompose_2.BlueChannel)
python_5 = GhPythonScript(w=decompose.XResolution, h=decompose.YResolution, reset=Button(), run=can)  # -> out, domain
# ---------- python_5: Python ----------
import ghpythonlib.components as gh
from scriptcontext import sticky as st


if reset:
    st["process_position"] = 0
    
if run:
    st["process_position"] += 20000

domain = gh.ConstructDomain(st["process_position"],st["process_position"] + 19999)
# ---------- end python_5 ----------
panel_10 = Panel(python_5.domain)
subset = SubList(List=decompose.RedChannel, Domain=python_5.domain, Wrap=True)  # -> List, Index
division_2 = Division(A="1", B=decompose.XResolution)
division_3 = Division(A="1", B=decompose.YResolution)
recgrid = Rectangular(
    Plane=PlaneXY(0, 0, 0),
    SizeX=division_2,
    SizeY=division_3,
    ExtentX=expr("x - 1", decompose.XResolution),
    ExtentY=expr("x - 1", decompose.YResolution))  # -> Cells, Points
subset_2 = SubList(List=rgb, Domain=python_5.domain, Wrap=True)  # -> List, Index
python_6 = GhPythonScript(x=subset.List)  # -> out, ids, legit; inputs x: list
# ---------- python_6: Python ----------
ids = [n - 1 for n in x]
legit = [n != -1 for n in ids]
# ---------- end python_6 ----------
flip_3 = FlipMatrix(Data=recgrid.Points)
dispatch_6 = Dispatch(List=python_6.ids, DispatchPattern=python_6.legit)  # -> ListA, ListB
subset_3 = SubList(List=flatten(flip_3), Domain=python_5.domain, Wrap=True)  # -> List, Index
dispatch_7 = Dispatch(List=subset_2.List, DispatchPattern=python_6.legit)  # -> ListA, ListB
dispatch_8 = Dispatch(List=subset_3.List, DispatchPattern=python_6.legit)  # -> ListA, ListB
geom_ids = RemoteSender(dispatch_6.ListA)
pdecon_2 = Deconstruct(Point=dispatch_8.ListA)  # -> XComponent, YComponent, ZComponent

num_2 = Number(csv_2.Values)
panel_11 = Panel("""0
1""")
item_10 = TreeItem(Tree=num_2, Path="2", Index=panel_11, Wrap=True)
item_11 = TreeItem(Tree=num_2, Path="0", Index=0, Wrap=True)
item_12 = ListItem(List=item_10, Index=0, Wrap=True)  # -> Item, Item1
neg_2 = Negative(Value=item_12.Item)
neg_3 = Negative(Value=item_12.Item1)
dom = ConstructDomain(DomainStart=neg_2, DomainEnd=item_12.Item)
dom_2 = ConstructDomain(DomainStart=neg_3, DomainEnd=item_12.Item1)
remap_2 = RemapNumbers(Value=pdecon_2.XComponent, Source=Domain(0, 1), Target=dom)  # -> Mapped, Clipped
remap_3 = RemapNumbers(Value=pdecon_2.YComponent, Source=Domain(0, 1), Target=dom_2)  # -> Mapped, Clipped
pt_2 = ConstructPoint(XCoordinate=remap_2.Mapped, YCoordinate=remap_3.Mapped, ZCoordinate=item_11)
cloud = ConstructCloud(Points=pt_2, Colors=dispatch_7.ListA)
scale_nu_2 = ScaleNU(Geometry=cloud, Plane=PlaneXY(0, 0, 0), ScaleX=1, ScaleY="-1", ScaleZ=1)  # -> Geometry, Transform

# ---- group: Render Mapped Mask
bake_geometry = Button()

# ----
minvert = InvertMatrix(Matrix=matrix, Tolerance=0)  # -> Matrix, Success
pt_3 = ConstructPoint(XCoordinate=0, YCoordinate=0, ZCoordinate=item_11)
pt_4 = Point(pt_3)
pt_5 = Point("0,0,0")
transform = Transform(Geometry=scale_nu_2.Geometry, Transform=minvert.Matrix)
transform_2 = Transform(Geometry=pt_5, Transform=minvert.Matrix)
transform_3 = Transform(Geometry=pt_4, Transform=minvert.Matrix)
decloud_3 = DeconstructCloud(Cloud=transform)  # -> Points, Normals, Colors
ln = Line(StartPoint=transform_2, EndPoint=decloud_3.Points)
mod_viewport = ModifyViewport(CameraLocation=transform_2, CameraTarget=transform_3, CameraLensLength="20.8090", AnimateRestore=False, RestoreFrames=10)

# ---- group: Generate View Spheres for Camera Location Diagram
sph = Sphere(Base=transform_2, Radius="0.5")
ln_2 = Line(StartPoint=transform_2, EndPoint=transform_3)
rec = DataRecorder(sph, DataLimit=-10, RecordData=True)
rec_2 = DataRecorder(ln_2, DataLimit=-10, RecordData=True)
rgb_2 = ColourRGB(Alpha=255, Red="255", Green="127", Blue=0)
srf = Surface(rec)
line = Line(rec_2)
col = Colour(rgb_2)
preview = CustomPreview(Geometry=[srf, line], Material=col)  # disabled

# ---- group: Construct UV Clouds
geom_ids_2 = RemoteReceiver(geom_ids)
sqgrid = Square(Plane=PlaneXY(0, 0, 0), Size=1, ExtentX="9", ExtentY="9")  # -> Cells, flatten(Points)
crv = Curve(sqgrid.Cells)
preview_2 = CustomPreview(Geometry=crv, Material="100,100,100")

# ----
# Extract Planes and Dimensions
pt_cloud_points_2 = RemoteReceiver(pt_cloud_points)
pt_6 = Point(pt_cloud_points_2)
bbox_4 = BoundingBox(Content=pt_6, Plane=graft(weave), UnionBox=True)  # -> Box, Box_2
boxprop_4 = BoxProperties(Box=bbox_4.Box)  # -> Center, Diagonal, Area, Volume, Degeneracy

bool_clean = RemoteReceiver()
cloud_colors_2 = RemoteReceiver(cloud_colors)
dispatch_9 = Dispatch(List=pt_6, DispatchPattern=bool_clean)  # -> ListA, ListB
dispatch_10 = Dispatch(List=cloud_colors_2, DispatchPattern=bool_clean)  # -> ListA, ListB
pt_good_points = RemoteSender(dispatch_9.ListA)
pt_good_colors = RemoteSender(dispatch_10.ListA)

pl_origin_2 = PlaneOrigin(Base=graft(weave), Origin=boxprop_4.Center)

bbox_5 = BoundingBox(Content=pt_6, Plane=pl_origin_2, UnionBox=True)  # -> Box, Box_2
boxprop_5 = BoxProperties(Box=bbox_5.Box)  # -> Center, Diagonal, Area, Volume, Degeneracy
pl_origin_3 = PlaneOrigin(Base=pl_origin_2, Origin=boxprop_5.Center)
debox_3 = DeconstructBox(Box=bbox_5.Box)  # -> Plane, X, Y, Z
dedomain_2 = DeconstructDomain(Domain=debox_3.X)  # -> Start, End
dedomain_3 = DeconstructDomain(Domain=debox_3.Y)  # -> Start, End
subtraction_3 = Subtraction(A=dedomain_2.End, B=dedomain_2.Start)
subtraction_4 = Subtraction(A=dedomain_3.End, B=dedomain_3.Start)

pln_2 = Plane(simplify(pl_origin_3))

deplane_4 = DeconstructPlane(Plane=pln_2)  # -> Origin, XAxis, YAxis, ZAxis
vdis_3 = VectorDisplay(Anchor=deplane_4.Origin, Vector=deplane_4.ZAxis)

# ---- group: Create Rectangles
rectangle = Rectangle(Plane=pln_2, XSize=simplify(subtraction_3), YSize=simplify(subtraction_4), Radius=0)  # -> Rectangle, Length
division_4 = Division(A=subtraction_3, B="-2")
division_5 = Division(A=subtraction_4, B="-2")
pl_origin_4 = PlaneOrigin(Base=pln_2, Origin="0,0,0")
vec_3 = VectorXYZ(XComponent=division_4, YComponent=division_5, ZComponent=0)  # -> Vector, Length
orient_4 = Orient(Geometry=vec_3.Vector, Source=PlaneXY(0, 0, 0), Target=pl_origin_4)  # -> Geometry, Transform
move_3 = Move(Geometry=rectangle.Rectangle, Motion=orient_4.Geometry)  # -> Geometry, Transform
rec_3 = Rectangle(move_3.Geometry)

# ---- group: Combine Overlapping Clouds
python_7 = GhPythonScript(planes=flatten(pln_2), rects=flatten(rec_3))  # -> out, groups, id_groups, geom_out; inputs planes: list of Plane, rects: list of Curve
# ---------- python_7: Python ----------
import ghpythonlib.components as gh
import ghpythonlib.treehelpers as tr

order = gh.Series(0,1,len(planes))
order = [int(i) for i in order]

wr_domain = gh.ConstructDomain(-1000000,1000000)
world_plane = gh.XYPlane(gh.ConstructPoint(0,0,0))
world_rect = gh.Rectangle(world_plane, wr_domain,wr_domain,0)

areas = gh.Area(rects)[0]

sorted_areas,order = gh.SortList(areas,order)
order = gh.ReverseList(order)
#planes = [planes[i] for i in order]

groups = [[]]
id_groups = [[]]
geom_out = []


for plane_id in order:
    plane = planes[plane_id]
    rect = rects[plane_id]
    area = areas[plane_id]
    
    if len(groups[-1]) == 0 and len(groups) == 1:
        groups[-1].append(plane)
        id_groups[-1].append(plane_id)
        continue
        
    flag = False
        
    for i in range(len(groups)):
        group_plane = groups[i][0]
        group_rect= rects[id_groups[i][0]]
        
        angle = gh.Angle(gh.DeconstructPlane(plane)[3],gh.DeconstructPlane(group_plane)[3])[0]
        angle = gh.Degrees(angle)
        if angle > 180:
            print(str(angle) + " : wtf?")
        if angle > 15 and angle < 165:
            continue
        
        group_rect_world = gh.Orient(group_rect,group_plane,world_plane)[0]
        rect_world = gh.Orient(rect,group_plane,world_plane)[0]
        
        # Make sure clouds aren't just aligned but far apart
        z = abs(gh.Deconstruct(gh.Area(rect_world)[1])[2])
        if z > 1:
            continue;
            
        rect_world = gh.ScaleNU(rect_world,world_plane,1,1,0)[0]
        intersection = gh.RegionIntersection(group_rect_world,rect_world)
        geom_out.append([rect_world,group_rect_world,intersection])
        if intersection is None: 
            continue
        intersection_area = gh.Area(intersection)[0]
        #print("{} : {}".format(intersection_area,area))
        if intersection_area  > area * 0.5:
            groups[i].append(plane)
            id_groups[i].append(plane_id)
            flag = True
            continue
    if flag == False:
        groups.append([])
        groups[-1].append(plane)
        
        id_groups.append([])
        id_groups[-1].append(plane_id)
        
groups = tr.list_to_tree(groups,source = [])

id_groups = tr.list_to_tree(id_groups,source = [])

geom_out = tr.list_to_tree(geom_out,source = [])
# ---------- end python_7 ----------
cld_clouds_3 = RemoteReceiver(cld_clouds)
item_13 = ListItem(List=cld_clouds_3, Index=python_7.id_groups, Wrap=True)
mcloud_3 = MergeClouds(Cloud=item_13)
item_14 = ListItem(List=python_7.groups, Index=0, Wrap=True)

# ---- group: Apply Groupings to Wall/Slab
item_15 = ListItem(List=flatten(bool_is_horizontal), Index=python_7.id_groups, Wrap=True)
item_16 = ListItem(List=item_15, Index=0, Wrap=True)
bool_is_horizontal_2 = RemoteSender(item_16)

# ----
bbox_6 = BoundingBox(Content=mcloud_3, Plane=item_14, UnionBox=False)  # -> Box, Box_2
debox_4 = DeconstructBox(Box=bbox_6.Box)  # -> Plane, X, Y, Z
dedomain_4 = DeconstructDomain(Domain=debox_4.X)  # -> Start, End
dedomain_5 = DeconstructDomain(Domain=debox_4.Y)  # -> Start, End
subtraction_5 = Subtraction(A=dedomain_4.End, B=dedomain_4.Start)
subtraction_6 = Subtraction(A=dedomain_5.End, B=dedomain_5.Start)

number_slider_9 = Slider(20, range=0..132)
item_17 = ListItem(List=flatten(item_14), Index=number_slider_9, Wrap=True)
item_18 = ListItem(List=flatten(mcloud_3), Index=number_slider_9, Wrap=True)
item_19 = ListItem(List=flatten(bbox_6.Box), Index=number_slider_9, Wrap=True)

# ---- group: Separate Slabs and Walls
bool_is_horizontal_3 = RemoteReceiver(bool_is_horizontal_2)
num_y = Number(flatten(subtraction_6))
num_x = Number(subtraction_5)
# Collate Element Types
pln_3 = Plane(item_14)
int = Integer(bool_is_horizontal_3)
dispatch_11 = Dispatch(List=flatten(pln_3), DispatchPattern=flatten(int))  # -> ListA, ListB
dispatch_12 = Dispatch(List=flatten(num_x), DispatchPattern=flatten(int))  # -> ListA, ListB
dispatch_13 = Dispatch(List=flatten(num_y), DispatchPattern=flatten(int))  # -> ListA, ListB
abs_4 = Absolute(Value=dispatch_12.ListA)
abs_5 = Absolute(Value=dispatch_12.ListB)
abs_6 = Absolute(Value=dispatch_13.ListA)
abs_7 = Absolute(Value=dispatch_13.ListB)

# ---- group: Create Rectangles
num_x_2 = Number(subtraction_5)
pln_4 = Plane(item_14)
num_y_2 = Number(subtraction_6)
rectangle_2 = Rectangle(Plane=pln_4, XSize=simplify(num_x_2), YSize=simplify(num_y_2), Radius=0)  # -> Rectangle, Length
division_6 = Division(A=num_x_2, B="-2")
division_7 = Division(A=num_y_2, B="-2")
pl_origin_5 = PlaneOrigin(Base=pln_4, Origin="0,0,0")
vec_4 = VectorXYZ(XComponent=division_6, YComponent=division_7, ZComponent=0)  # -> Vector, Length
orient_5 = Orient(Geometry=vec_4.Vector, Source=PlaneXY(0, 0, 0), Target=pl_origin_5)  # -> Geometry, Transform
move_4 = Move(Geometry=rectangle_2.Rectangle, Motion=orient_5.Geometry)  # -> Geometry, Transform
rec_4 = Rectangle(move_4.Geometry)
srf_2 = Surface(rec_4)
srf_surfaces_for_projection = RemoteSender(srf_2)

# ----
srf_surfaces_for_projection_2 = RemoteReceiver(srf_surfaces_for_projection)
merge_4 = Merge(Data1=flatten(srf_surfaces_for_projection_2), Data2=srf_cylinders_for_projections_3)

# ---- group: Render Mapped Mask (continued)
lng_3 = ListLength(List=merge_4)
series = Series(Start="1", Step=1, Count=lng_3)
integer_division = IntegerDivision(A=series, B="255")
mod_2 = Modulus(A=series, B="255")
rgb_3 = ColourRGB(Alpha="255", Red=mod_2, Green=mod_2, Blue=mod_2)
createatts = CreateAttributes(LayerName="bake", Color=rgb_3, enableFullPath=False)
preview_3 = CustomPreview(Geometry=merge_4, Material=rgb_3)
bake = BakeGeometry(Bake=bake_geometry, Geometry=merge_4, Attributes=createatts, DeleteOldBakes=False, PreserveTrees=False)

# ----
item_20 = ListItem(List=merge_4, Index=dispatch_6.ListA, Wrap=True)

slx = SurfaceLine(Surface=reparameterize(item_20), Line=ln, LimitToFirst=True)  # -> Curves, simplify(Points), simplify(UVPoints), Normal
clean_3 = CleanTree(RemoveNulls=True, RemoveInvalid=True, RemoveEmpty=False, Tree=graft(slx.UVPoints))  # -> simplify(Tree)
clean_4 = CleanTree(RemoveNulls=True, RemoveInvalid=True, RemoveEmpty=False, Tree=graft(slx.Points))  # -> simplify(Tree)
null_2 = NullItem(Item=clean_4)  # -> flatten(NullFlags), InvalidFlags, Description
dispatch_14 = Dispatch(List=decloud_3.Colors, DispatchPattern=null_2.NullFlags)  # -> ListA, ListB
cloud_2 = ConstructCloud(Points=flatten(clean_4), Colors=dispatch_14.ListB)
cloud_3 = ConstructCloud(Points=flatten(clean_3), Colors=dispatch_14.ListB)
rec_5 = DataRecorder(cloud_2, DataLimit=-10, RecordData=True)
rec_6 = DataRecorder(cloud_3, DataLimit=-10, RecordData=True)
clo_9 = Cloud(rec_5)

srf_surfaces_for_projection_3 = RemoteReceiver(srf_surfaces_for_projection)
dispatch_15 = Dispatch(List=flatten(mcloud_3), DispatchPattern=flatten(int))  # -> ListA, ListB
clo_10 = Cloud(dispatch_15.ListB)

# ---- group: Separate Vertical Elements into Walls, Beams, Columns
pln_ver = Plane(dispatch_11.ListB)
num_x_ver = Number(abs_5)
num_y_ver = Number(abs_7)
expression_3 = Expression(x=num_x_ver, y=num_y_ver, n=num, Expression="x / y > n")
expression_4 = Expression(x=num_x_ver, y=num_y_ver, n=num, Expression="y / x > n")
multiplication_3 = Multiplication(A=expression_3, B="1")
multiplication_4 = Multiplication(A=expression_4, B="2")
addition_2 = Addition(A=multiplication_3, B=multiplication_4)
int_vertical_sift = RemoteSender(addition_2)
sift_cleaned = SiftCleaned(L=pln_ver, P=addition_2)  # -> T, T_2, T_3
sift_cleaned_2 = SiftCleaned(L=num_x_ver, P=addition_2)  # -> T, T_2, T_3
sift_cleaned_3 = SiftCleaned(L=num_y_ver, P=addition_2)  # -> T, T_2, T_3
division_8 = Division(A=sift_cleaned_3.T_3, B="-2")
Z_2 = UnitZ(Factor=division_8)
move_5 = Move(Geometry=sift_cleaned.T_3, Motion=Z_2)  # -> Geometry, Transform
num_x_walls = RemoteSender(sift_cleaned_2.T)
pln_walls = RemoteSender(sift_cleaned.T)
pln_columns_plane = RemoteSender(move_5.Geometry)
num_d_columns_plane = RemoteSender(sift_cleaned_2.T_3)
num_y_walls = RemoteSender(sift_cleaned_3.T)
num_h_columns_plane = RemoteSender(sift_cleaned_3.T_3)

# ----
sift_cleaned_4 = SiftCleaned(L=dispatch_15.ListB, P=addition_2)  # -> T, T_2, T_3
clo_11 = Cloud(sift_cleaned_4.T_3)
num_h_columns_plane_2 = RemoteReceiver(num_h_columns_plane)
num_y_walls_2 = RemoteReceiver(num_y_walls)
num_d_columns_plane_2 = RemoteReceiver(num_d_columns_plane)
num_x_walls_2 = RemoteReceiver(num_x_walls)
pln_walls_2 = RemoteReceiver(pln_walls)
pln_columns_plane_2 = RemoteReceiver(pln_columns_plane)

division_9 = Division(A=sift_cleaned_3.T_2, B="-2")
Z_3 = UnitZ(Factor=division_9)
move_6 = Move(Geometry=sift_cleaned.T_2, Motion=Z_3)  # -> Geometry, Transform

# ---- group: Separate Horizontal Elements into Slabs and Beams
num_y_hor = Number(abs_6)
pln_hor = Plane(dispatch_11.ListA)
num_x_hor = Number(abs_4)
expression_5 = Expression(x=num_x_hor, y=num_y_hor, Expression="(x / y > 5) or (y / x > 5)")
bool_is_beam = RemoteSender(expression_5)
# Add to Database
dispatch_16 = Dispatch(List=pln_hor, DispatchPattern=expression_5)  # -> ListA, ListB
dispatch_17 = Dispatch(List=num_x_hor, DispatchPattern=expression_5)  # -> ListA, ListB
dispatch_18 = Dispatch(List=num_y_hor, DispatchPattern=expression_5)  # -> ListA, ListB
lng_4 = ListLength(List=dispatch_18.ListA)
num_y_slabs = RemoteSender(dispatch_18.ListB)
pln_slabs = RemoteSender(dispatch_16.ListB)
num_x_slabs = RemoteSender(dispatch_17.ListB)
repeat_3 = RepeatData(Data="0.01", Length=lng_4)
lng_5 = ListLength(List=sift_cleaned_3.T_2)
repeat_4 = RepeatData(Data="0.01", Length=lng_5)
entwine = Entwine(Branch00=dispatch_18.ListA, Branch01=repeat_4, FlattenInputs=True)  # -> flatten(Result)
entwine_2 = Entwine(Branch00=repeat_3, Branch01=sift_cleaned_3.T_2, FlattenInputs=True)  # -> flatten(Result)
merge_5 = Merge(Data1=dispatch_16.ListA, Data2=move_6.Geometry)
merge_6 = Merge(Data1=dispatch_17.ListA, Data2=sift_cleaned_2.T_2)
pln_beams = RemoteSender(merge_5)
num_x_beams = RemoteSender(merge_6)
num_z_beams = RemoteSender(entwine_2)
num_y_beams = RemoteSender(entwine)

# ----
dispatch_19 = Dispatch(List=dispatch_15.ListA, DispatchPattern=expression_5)  # -> ListA, ListB

# ---- group: Divide Surfaces
srf_surfaces_for_projection_4 = RemoteReceiver(srf_surfaces_for_projection)
bool_is_horizontal_4 = RemoteReceiver(bool_is_horizontal_2)
dispatch_20 = Dispatch(List=flatten(srf_surfaces_for_projection_4), DispatchPattern=flatten(bool_is_horizontal_4))  # -> ListA, ListB
int_vertical_sift_2 = RemoteReceiver(int_vertical_sift)
bool_is_beam_2 = RemoteReceiver(bool_is_beam)
dispatch_21 = Dispatch(List=dispatch_20.ListA, DispatchPattern=bool_is_beam_2)  # -> ListA, ListB
sift_cleaned_5 = SiftCleaned(L=dispatch_20.ListB, P=int_vertical_sift_2)  # -> T, T_2, T_3
merge_7 = Merge(Data1=dispatch_21.ListA, Data2=sift_cleaned_5.T_2)
srf_columns = Surface(sift_cleaned_5.T_3)
srf_beams = Surface(merge_7)
srf_slabs = Surface(dispatch_21.ListB)
srf_walls = Surface(sift_cleaned_5.T)

# ----
num_x_beams_2 = RemoteReceiver(num_x_beams)
num_y_beams_2 = RemoteReceiver(num_y_beams)
num_z_beams_2 = RemoteReceiver(num_z_beams)
pln_beams_2 = RemoteReceiver(pln_beams)

panel_12 = Panel("""0,0.5
1,0.5""")
evalsrf = EvaluateSurface(Surface=reparameterize(graft(srf_beams)), Point=panel_12)  # -> Point, Normal, UDirection, VDirection, Frame
item_21 = ListItem(List=evalsrf.Point, Index=0, Wrap=True)  # -> Item, Item1
ln_3 = Line(StartPoint=item_21.Item, EndPoint=item_21.Item1)
clusterl = ClusterLines(Lines=flatten(ln_3), Clusters=Slider(10, range=2..20), Iterations="50", Seed=123)  # -> Clusters, Seeds

evalsrf_2 = EvaluateSurface(Surface=reparameterize(srf_beams), Point="0.5,0.5")  # -> Point, Normal, UDirection, VDirection, Frame
pt_7 = Point(evalsrf_2.Point)
transform_4 = Transform(Geometry=pt_7, Transform=matrix_5)
devec_6 = DeconstructVector(Vector=evalsrf_2.UDirection)  # -> XComponent, YComponent, ZComponent
angle = Angle(VectorA=evalsrf_2.UDirection, VectorB=Y, Plane=xy)  # -> Angle, Reflex
expression_6 = Expression(x=angle.Angle, Expression="if(x > (pi / 2),x- pi,x)")
num_x_beams_3 = RemoteReceiver(num_x_beams)
num_y_beams_3 = RemoteReceiver(num_y_beams)
pdecon_3 = Deconstruct(Point=transform_4)  # -> XComponent, YComponent, ZComponent
cluster_2 = _01(num=pdecon_3.XComponent, num_2=number_slider_6)
cluster_3 = _01(num=pdecon_3.YComponent, num_2=number_slider_6)
cluster_4 = _01(num=pdecon_3.ZComponent, num_2=number_slider_6)
cluster_5 = _01(num=devec_6.XComponent, num_2=number_slider_4)
cluster_6 = _01(num=devec_6.YComponent, num_2=number_slider_4)
cluster_7 = _01(num=devec_6.ZComponent, num_2=number_slider_4)
cluster_8 = _01(num=angle.Angle, num_2=number_slider_5)
cluster_9 = _01(num=expression_6, num_2=number_slider_5)
cluster_10 = _01(num=num_x_beams_3, num_2="1")
cluster_11 = _01(num=num_y_beams_3, num_2="1")
merge_8 = Merge(Data1=simplify(graft(cluster_2)), Data2=simplify(graft(cluster_3)), Data3=simplify(graft(cluster_4)))
merge_9 = Merge(
    Data1=simplify(graft(cluster_2)),
    Data2=simplify(graft(cluster_3)),
    Data3=simplify(graft(cluster_4)),
    Data4=simplify(graft(cluster_5)),
    Data5=simplify(graft(cluster_6)),
    Data6=simplify(graft(cluster_7)),
    Data7=simplify(graft(cluster_9)))
tensor = ConstructTensor(Values=merge_8)  # -> flatten(Tensor)
tensorset = ConstructTensorSet(Tensors=tensor)
t_sne = TSNE(Data=tensorset, Perplexity=Slider(5.6, range=5..12.5), Theta=0.5, Outputs=Slider(3, range=3..6), Seed=123)  # disabled
kmeans = KMeansClustering(Data=tensorset, Clusters=number_slider_7, Iterations=Slider(50, range=50..100), Seed=123)  # -> Clusters, Indices
item_22 = ListItem(List=flatten(ln_3), Index=kmeans.Indices, Wrap=True)
divide = DivideCurve(Curve=item_22, Count=10, Kinks=False)  # -> simplify(Points), Tangents, Parameters
trim = TrimTree(Tree=divide.Points, Depth=1)
item_23 = ListItem(List=srf_beams, Index=kmeans.Indices, Wrap=True)

# ---- group: Colorize by DB Segment
geo = Geometry(item_23)
tstat = TreeStatistics(Tree=geo)  # -> Paths, Length, Count
range = Range(Domain=Domain(0, 1), Steps=tstat.Count)
subtraction_7 = Subtraction(A=tstat.Count, B="1")
subset_4 = SubList(List=range, Domain=subtraction_7, Wrap=True)  # -> List, Index
hsv = ColourHSV(Alpha=1, Hue=subset_4.List, Saturation=1, Value=1)
preview_4 = CustomPreview(Geometry=geo, Material=graft(hsv))

# ----
bbox_7 = BoundingBox(Content=item_23, Plane=PlaneXY(0, 0, 0), UnionBox=False)  # -> Box, Box_2; disabled
bbox_8 = BoundingBox(Content=item_23, Plane=PlaneXY(0, 0, 0), UnionBox=True)  # -> Box, Box_2
fline = FitLine(Points=trim)
sunion = SolidUnion(Breps=bbox_7.Box)
sdiff = SolidDifference(BrepsA=bbox_8.Box, BrepsB=sunion)
crv_cp = CurveClosestPoint(Point=trim, Curve=fline)  # -> Point, Parameter, Distance
volume = Volume(Geometry=sdiff)  # -> Volume, Centroid
ma_2 = MassAddition(Input=flatten(crv_cp.Distance))  # -> Result, PartialResults
expression_7 = Expression(c=number_slider_7, d=ma_2.Result, Expression="d + (c * 10)")
ma_3 = MassAddition(Input=flatten(volume.Volume))  # -> Result, PartialResults
num_3 = Number(expression_7)

pln_slabs_2 = RemoteReceiver(pln_slabs)
deplane_5 = DeconstructPlane(Plane=pln_slabs_2)  # -> Origin, XAxis, YAxis, ZAxis
pdecon_4 = Deconstruct(Point=deplane_5.Origin)  # -> XComponent, YComponent, ZComponent
pdecon_5 = Deconstruct(Point=deplane_5.XAxis)  # -> XComponent, YComponent, ZComponent
lng_6 = ListLength(List=pln_slabs_2)
expression_8 = Expression(x=pdecon_5.XComponent, y=pdecon_5.YComponent, Expression="atan2(y,x)")
num_x_slabs_2 = RemoteReceiver(num_x_slabs)
num_y_slabs_2 = RemoteReceiver(num_y_slabs)
str_site_uuid_3 = RemoteReceiver(str_site_uuid)
repeat_5 = RepeatData(Data="slab", Length=lng_6)
repeat_6 = RepeatData(Data="0", Length=lng_6)
merge_10 = Merge(
    Data1=simplify(graft(repeat_5)),
    Data2=simplify(graft(pdecon_4.XComponent)),
    Data3=simplify(graft(pdecon_4.YComponent)),
    Data4=simplify(graft(pdecon_4.ZComponent)),
    Data5=simplify(graft(num_x_slabs_2)),
    Data6=simplify(graft(num_y_slabs_2)),
    Data7=simplify(graft(repeat_6)),
    Data8=simplify(graft(expression_8)))
format_5 = Format(Format="uuid_to_bin('{0}')", Culture=127, Data0=str_site_uuid_3)
format_6 = Format(Format="'{0}'", Culture=127, Data0=merge_10)
ins_7 = InsertItems(List=format_6, Item=graft(format_5), Indices="0", Wrap=True)  # -> simplify(List)
ins_8 = InsertItems(List=ins_7, Item=graft("uuid_to_bin(uuid())"), Indices="0", Wrap=True)  # -> simplify(List)
join_2 = TextJoin(Text=ins_8, Join=",")  # -> flatten(Result)

pln_columns_plane_3 = RemoteReceiver(pln_columns_plane)
deplane_6 = DeconstructPlane(Plane=pln_columns_plane_3)  # -> Origin, XAxis, YAxis, ZAxis
pdecon_6 = Deconstruct(Point=deplane_6.XAxis)  # -> XComponent, YComponent, ZComponent
pdecon_7 = Deconstruct(Point=deplane_6.Origin)  # -> XComponent, YComponent, ZComponent
expression_9 = Expression(x=pdecon_6.XComponent, y=pdecon_6.YComponent, Expression="atan2(y,x)")
lng_7 = ListLength(List=pln_columns_plane_3)
num_d_columns_plane_3 = RemoteReceiver(num_d_columns_plane)
num_h_columns_plane_3 = RemoteReceiver(num_h_columns_plane)
repeat_7 = RepeatData(Data="column_rect", Length=lng_7)
str_site_uuid_4 = RemoteReceiver(str_site_uuid)
entwine_3 = Entwine(
    Branch00=repeat_7,
    Branch01=pdecon_7.XComponent,
    Branch02=pdecon_7.YComponent,
    Branch03=pdecon_7.ZComponent,
    Branch04=num_d_columns_plane_3,
    Branch05=num_d_columns_plane_3,
    Branch06=num_h_columns_plane_3,
    Branch07=expression_9,
    FlattenInputs=True)
format_7 = Format(Format="uuid_to_bin('{0}')", Culture=127, Data0=str_site_uuid_4)
flip_4 = FlipMatrix(Data=entwine_3)
format_8 = Format(Format="'{0}'", Culture=127, Data0=flip_4)
ins_9 = InsertItems(List=format_8, Item=graft(format_7), Indices="0", Wrap=True)  # -> simplify(List)
ins_10 = InsertItems(List=ins_9, Item=graft("uuid_to_bin(uuid())"), Indices="0", Wrap=True)  # -> simplify(List)
join_3 = TextJoin(Text=ins_10, Join=",")  # -> flatten(Result)

pln_walls_3 = RemoteReceiver(pln_walls)
deplane_7 = DeconstructPlane(Plane=pln_walls_3)  # -> Origin, XAxis, YAxis, ZAxis
pdecon_8 = Deconstruct(Point=deplane_7.XAxis)  # -> XComponent, YComponent, ZComponent
lng_8 = ListLength(List=pln_walls_3)
expression_10 = Expression(x=pdecon_8.XComponent, y=pdecon_8.YComponent, Expression="atan2(y,x)")
num_x_walls_3 = RemoteReceiver(num_x_walls)
num_y_walls_3 = RemoteReceiver(num_y_walls)
repeat_8 = RepeatData(Data="wall", Length=lng_8)
repeat_9 = RepeatData(Data="0", Length=lng_8)
pdecon_9 = Deconstruct(Point=deplane_7.Origin)  # -> XComponent, YComponent, ZComponent
str_site_uuid_5 = RemoteReceiver(str_site_uuid)
format_9 = Format(Format="uuid_to_bin('{0}')", Culture=127, Data0=str_site_uuid_5)
merge_11 = Merge(
    Data1=simplify(graft(repeat_8)),
    Data2=simplify(graft(pdecon_9.XComponent)),
    Data3=simplify(graft(pdecon_9.YComponent)),
    Data4=simplify(graft(pdecon_9.ZComponent)),
    Data5=simplify(graft(num_x_walls_3)),
    Data6=simplify(graft(repeat_9)),
    Data7=simplify(graft(num_y_walls_3)),
    Data8=simplify(graft(expression_10)))
format_10 = Format(Format="'{0}'", Culture=127, Data0=merge_11)
ins_11 = InsertItems(List=format_10, Item=graft(format_9), Indices="0", Wrap=True)  # -> simplify(List)
ins_12 = InsertItems(List=ins_11, Item=graft("uuid_to_bin(uuid())"), Indices="0", Wrap=True)  # -> simplify(List)
join_4 = TextJoin(Text=ins_12, Join=",")  # -> flatten(Result)

num_x_beams_4 = RemoteReceiver(num_x_beams)
num_y_beams_4 = RemoteReceiver(num_y_beams)
num_z_beams_3 = RemoteReceiver(num_z_beams)

# ----
# DATABASE
pln_beams_3 = RemoteReceiver(pln_beams)
deplane_8 = DeconstructPlane(Plane=pln_beams_3)  # -> Origin, XAxis, YAxis, ZAxis
pdecon_10 = Deconstruct(Point=deplane_8.XAxis)  # -> XComponent, YComponent, ZComponent
pdecon_11 = Deconstruct(Point=deplane_8.Origin)  # -> XComponent, YComponent, ZComponent
expression_11 = Expression(x=pdecon_10.XComponent, y=pdecon_10.YComponent, Expression="atan2(y,x)")
lng_9 = ListLength(List=pln_beams_3)
repeat_10 = RepeatData(Data="beam", Length=lng_9)
str_site_uuid_6 = RemoteReceiver(str_site_uuid)
entwine_4 = Entwine(
    Branch00=repeat_10,
    Branch01=pdecon_11.XComponent,
    Branch02=pdecon_11.YComponent,
    Branch03=pdecon_11.ZComponent,
    Branch04=num_x_beams_4,
    Branch05=num_y_beams_4,
    Branch06=num_z_beams_3,
    Branch07=expression_11,
    FlattenInputs=True)
format_11 = Format(Format="uuid_to_bin('{0}')", Culture=127, Data0=str_site_uuid_6)
flip_5 = FlipMatrix(Data=entwine_4)
format_12 = Format(Format="'{0}'", Culture=127, Data0=flip_5)
ins_13 = InsertItems(List=format_12, Item=graft(format_11), Indices="0", Wrap=True)  # -> simplify(List)
ins_14 = InsertItems(List=ins_13, Item=graft("uuid_to_bin(uuid())"), Indices="0", Wrap=True)  # -> simplify(List)
join_5 = TextJoin(Text=ins_14, Join=",")  # -> flatten(Result)

merge_12 = Merge(Data1=join_5, Data2=join_3, Data3=gate.Target0, Data4=join_2, Data5=join_4)
insert = SQLInsertCommand(Table="site_elements", Columns="uuid,site_uuid,type,x,y,z,w,l,h,r", Data=merge_12, Update=False, Connector="MySQL")
rep = ReplaceText(Text=insert, Find="INSERT", Replace="INSERT IGNORE", RecursiveReplace=False)

# ---- group: Add to Database
panel_13 = Panel("""START TRANSACTION;
COMMIT;""")
txt_sql_commands = Text(flatten(rep))
text_cstring_3 = RemoteReceiver(text_cstring)
ins_15 = InsertItems(List=panel_13, Item=txt_sql_commands, Indices="1", Wrap=True)
command = RDBMSCommand(ConnectString=text_cstring_3, ConnectToggle=Toggle(False), Command=ins_15, Connector="MySQL")
panel_14 = Panel(command)

# ----
panel_15 = Panel(txt_sql_commands)
item_24 = ListItem(List=txt_sql_commands, Index=0, Wrap=True)
panel_16 = Panel(item_24)

# ---- group: Construct UV Clouds (continued)
pt_8 = Point(flatten(clean_3))
pt_9 = Point(simplify(graft(pt_8)))
viewer = ParamViewer(pt_9)
graft = GraftTree(Tree=dispatch_14.ListB, IncludeEmptyLists=True, IncludeNullItems=True)  # -> simplify(Tree)
dispatch_22 = Dispatch(List=geom_ids_2, DispatchPattern=null_2.NullFlags)  # -> ListA, ListB
path_11 = ConstructPath(Indices=graft(dispatch_22.ListB))  # -> flatten(Branch)
c_script = CSharpScript(data=pt_9, newPaths=path_11)  # -> out, newTree; inputs data: tree, newPaths: tree
# ---------- c_script: C# usings ----------
using System.Threading.Tasks;
using System.Linq;
# ---------- c_script: C# ----------
    _data = data;
    _newPaths = newPaths.AllData();
    _paths = new GH_Path[_data.BranchCount];

    ValidateInput();


    if (_newPaths.Count > 100)
    {
      newTree = ReplacePathsAsync();
    }
    else
    {
      newTree = ReplacePath();
    }
# ---------- c_script: C# additional code ----------
  DataTree<object> _data;
  volatile GH_Path[] _paths;
  volatile List<object> _newPaths;

  void ValidateInput()
  {
    if (_newPaths == null || _data == null)
      throw new ArgumentException("Arguments must not be null");

    // check input type
    if (_newPaths.Count == 0 || !(_newPaths[0] is GH_Path))
      throw new ArgumentException("Provided paths count must not be zero and have to be of Type GH_Path");


  }

  DataTree<object> ReplacePathsAsync()
  {
    int range = _data.BranchCount / 4;

    Task[] tasks = new Task[4];
    tasks[0] = ReplacePathsChunk(0, range);
    tasks[1] = ReplacePathsChunk(range + 1, (range * 2));
    tasks[2] = ReplacePathsChunk((range * 2) + 1, (range * 3));
    tasks[3] = ReplacePathsChunk((range * 3) + 1, _data.BranchCount - 1);
    Task.WaitAll(tasks);

    DataTree<object> newDataTree = new DataTree<object>();
    for (int i = 0; i < _data.BranchCount; i++)
    {
      newDataTree.AddRange(_data.Branch(i), _paths[i] == null ? _data.Path(i) : _paths[i]);
    }
    return newDataTree;
  }


  Task ReplacePathsChunk(int indexA, int indexB) {
    return Task.Run(() => {
      for (int i = indexA; i <= indexB; i++) {
        _paths[i] = (GH_Path) _newPaths[i];
      }});

  }

  DataTree<object> ReplacePath() {
    DataTree<object> newDataTree = new DataTree<object>();
    for (int i = 0; i < _data.BranchCount; i++) {
      newDataTree.AddRange(_data.Branch(i), (GH_Path) _newPaths[i]);
    }
    return newDataTree;
  }
# ---------- end c_script ----------
tstat_2 = TreeStatistics(Tree=simplify(c_script.newTree))  # -> Paths, Length, Count
dpath = DeconstructPath(Branch=tstat_2.Paths)
item_25 = ListItem(List=sqgrid.Points, Index=dpath, Wrap=True)
match = MatchTree(Tree=item_25, Guide=c_script.newTree)
move_7 = Move(Geometry=c_script.newTree, Motion=match)  # -> Geometry, Transform

# ----
c_script_2 = CSharpScript(data=graft, newPaths=path_11)  # -> out, newTree; inputs data: tree, newPaths: tree; same code as c_script

# ---- group: Construct UV Clouds (continued)
cloud_4 = ConstructCloud(Points=move_7.Geometry, Colors=c_script_2.newTree)
rec_7 = DataRecorder(cloud_4, DataLimit=-10, RecordData=True)
mcloud_4 = MergeClouds(Cloud=rec_7)  # -> flatten(Cloud)

# ==== cluster SiftCleaned
L = ClusterInput()
P = ClusterInput()
sift = SiftPattern(List=L, SiftPattern=P)  # -> Output0, Output1, Output2
clean = CleanTree(RemoveNulls=True, RemoveInvalid=True, RemoveEmpty=False, Tree=sift.Output0)
clean_2 = CleanTree(RemoveNulls=True, RemoveInvalid=True, RemoveEmpty=False, Tree=sift.Output1)
clean_3 = CleanTree(RemoveNulls=True, RemoveInvalid=True, RemoveEmpty=False, Tree=sift.Output2)
T = ClusterOutput(clean)
T_2 = ClusterOutput(clean_2)
T_3 = ClusterOutput(clean_3)

# ==== cluster Cluster
num_x = ClusterInput()
pln = ClusterInput()
num_y = ClusterInput()

# ---- group: Create Rectangles
num_x_2 = Number(num_x)
pln_2 = Plane(pln)
num_y_2 = Number(num_y)
rectangle = Rectangle(Plane=pln_2, XSize=simplify(num_x_2), YSize=simplify(num_y_2), Radius=0)  # -> Rectangle, Length
division = Division(A=num_x_2, B="-2")
division_2 = Division(A=num_y_2, B="-2")
pl_origin = PlaneOrigin(Base=pln_2, Origin="0,0,0")
vec = VectorXYZ(XComponent=division, YComponent=division_2, ZComponent=0)  # -> Vector, Length
orient = Orient(Geometry=vec.Vector, Source=PlaneXY(0, 0, 0), Target=pl_origin)  # -> Geometry, Transform
move = Move(Geometry=rectangle.Rectangle, Motion=orient.Geometry)  # -> Geometry, Transform
rec = Rectangle(move.Geometry)
srf = Surface(rec)

# ----
srf_2 = ClusterOutput(srf)

# ==== cluster _01
num = ClusterInput()
num_2 = ClusterInput()
num_3 = Number(num)
num_4 = Number(num_2)
bnd = Bounds(Numbers=num_3)
remap = RemapNumbers(Value=num_3, Source=bnd, Target=num_4)  # -> Mapped, Clipped
num_5 = Number(remap.Mapped)
num_6 = ClusterOutput(num_5)
