# Grasshopper definition Design for Fabrication + Database.gh (Grasshopper 1.0.7)
# plug-ins: NGon, Heteroptera, Telepathy, karambaGH, Pufferfish, Tarsier, Human, Human UI, ProvingGround.Slingshot, Octopus, MetaHopper, LunchBox, Fologram For Grasshopper Utilities, MeshEdit Components

# ---- group: Required Plugins
# Instructions
# 'Raw' parameters refer to components before scaling and offset
docinfo = DocumentInfo(AutoUpdate=False, Recursive=False)  # -> DocumentName, DocumentFilePath, Components, Params, _3rdPartyAssemblies
# White border components are UI controls
# Cyan border components may require reselecting a local filepath
# Gray border implies under development
panel = Panel(",")
split = TextSplit(Text=docinfo._3rdPartyAssemblies, Separators=panel)
item = ListItem(List=split, Index=0, Wrap=True)  # -> flatten(Item)
found_plugins = Panel(item)
txt = Text(["NGonGh", "Heteroptera", "karambaGH", "Pufferfish", "Mesh Pipe", "Parakeet", "Tarsier", "Human", "HumanUI", "ProvingGround.Slingshot", "Octopus", "Telepathy"])
required_plugins = Panel(txt)

# ---- group: Create Raw Surface
number_slider = Slider(-0.13, range=-0.25..0)
number_slider_2 = Slider(332, range=325..340)
number_slider_3 = Slider(34, range=30..40)
# Create Design Form
cluster = Cluster(
    X=Slider(0, range=0..2),
    Y_3=Slider(0, range=0..2),
    Y=Slider(1.879, range=1..3),
    Z=Slider(-0.3, range=-0.3..2),
    F=Slider(1.995, range=1..2),
    A=number_slider_3,
    Y_2=Slider(2, range=2..3),
    x=number_slider_3,
    Z_2=[Slider(1.88, range=0..3), Slider(2.26, range=1..3)],
    x_2=number_slider,
    F_2=Slider(-2, range=-3..-2),
    X_2=number_slider,
    A_2=number_slider_2,
    x_3=number_slider,
    x_4=number_slider_2)

# ----
textbox = CreateTextBox(Label="Site Latitude", DefaultText="41.4", UpdateButton=True, showLabel=True)
textbox_2 = CreateTextBox(Label="Longitude", DefaultText="2.25", UpdateButton=True, showLabel=True)
merge = Merge(Data1=textbox, Data2=textbox_2)
stack = CreateStack(UIElements=merge, Horizontal=True)

# ----
# Querying the Database
file = ReadFile(
    File="C:\Users\Roberto\IAAC\02 Curso\01. Second Year\Thesis Research Studio\Week 22\Scripts\connection.txt",
    PerLineParse=True)
cstring = ConnectionString(
    CommandTimeout="20",
    ConnectionTimeout="5",
    Connector="MySQL",
    Database="{3}",
    Password="{2}",
    Port="3306",
    Server="{0}",
    UserID="{1}")
item_2 = ListItem(List=file, Index=0, Wrap=True)  # -> Item, Item1, Item2, Item3
format = Format(Format=cstring, Culture=127, Data0=item_2.Item, Data1=item_2.Item1, Data2=item_2.Item2, Data3=item_2.Item3)

maximum_distance = Slider(200, range=0..200)
slider = CreateSlider(Slider=maximum_distance, ShowBounds=False, ShowTicks=False, ShowTooltip=False, ShowValLabel=True, showLabel=True)

minimal_quality = Slider(0, range=0..100)
slider_2 = CreateSlider(Slider=minimal_quality, ShowBounds=False, ShowTicks=False, ShowTooltip=False, ShowValLabel=True, showLabel=True)

label = CreateLabel(LabelText=" ", LabelSize=12, Justification=0)

separator = CreateSeparator(Thickness=0.5, Horizontal=True, Color=RGB(0, 0, 0))
swatch = ColourSwatch(SwatchColor=RGB(0, 0, 0))
panel_2 = Panel("18")
panel_3 = Panel("6")
# Optimization
galapagos = Galapagos(fitness=num_20, gene=[genes, number_slider_3, number_slider, number_slider_2, number_slider_6, number_slider_7])
# Visualization
swatch_2 = ColourSwatch(SwatchColor=RGB(255, 136, 0))
color_cut_item = RemoteSender(ColourSwatch(SwatchColor=RGB(158, 136, 111)))
color_found_item = RemoteSender(swatch_2)
color_not_found_item = RemoteSender(ColourSwatch(SwatchColor=RGB(71, 71, 71)))
num = Number(Slider(0, range=0..2))
octopus = Octopus(
    OctopusData_gene=[number_slider_2, number_slider, number_slider_3, genes, number_slider_6, number_slider_7],
    OctopusData_obj=[num_23, num_20])
color_not_found_item_2 = RemoteReceiver(color_not_found_item)
color_found_item_2 = RemoteReceiver(color_found_item)
color_cut_item_2 = RemoteReceiver(color_cut_item)
# Offset Layers
panel_4 = Panel("1.4")
number_slider_4 = Slider(98, range=0..100)
number_slider_5 = Slider(4.5, range=0..4.5)
panel_5 = Panel("4.5")
sqgrid = Square(Plane=PlaneXY(0, 0, 0), Size=Slider(0.128, range=0..1), ExtentX="20", ExtentY="5")  # -> Cells, Points
flatten = FlattenTree(Tree=sqgrid.Points, Path="{0}")

# ---- group: Design
# Save Fabrication Numbers
num_2 = Number([19.88643032, 39.8050472, 54.70678369, 102.085541, 73.09186438, 66.70844372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])
num_3 = Number([-16.56867893, -4.175028862, -2.091697023, 3.144048605, -8.489401059, 19.78973306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])
num_4 = Number([-8.264400533, 0.5569149769, 6.260595236, -2.621854871, -12.51024698, 15.49237771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])
num_5 = Number([0, 0, 0, 1, 1, 1, 2, 2, 2, 3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])
num_6 = Number([0, 1, 3, 0, 1, 9, 2, 3, 5, 0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])
element_length = Panel(num_2)
angle_a = Panel(num_3)
angle_b = Panel(num_4)
base_ids = Panel(num_5)
secondary_ids = Panel(num_6)
entwine = Entwine(
    Branch00=element_length,
    Branch01=angle_a,
    Branch02=angle_b,
    Branch03=base_ids,
    Branch04=secondary_ids,
    FlattenInputs=True)
csv = CreateCSV(DataGridHeaders="length,angle_a,angle_b,base_ids,secondary_ids", ValueTree=entwine, Delimiter=",")

# ----
# Visualization
final_geometry = BooleanToggle(False)
uv_space = BooleanToggle(True)
scale_person = BooleanToggle(False)
individual_connection = BooleanToggle(False)

# ----
# Preview Scale Person
mesh = Mesh(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)  # disabled
swatch_3 = ColourSwatch(SwatchColor=RGB(79, 79, 79))  # disabled
cluster_2 = Cluster_3(M=mesh)  # disabled
panel_6 = Panel("1")  # disabled
preview = PreviewPointCloud(PointCloud=cluster_2, Weight=panel_6)  # disabled
preview_2 = CustomPreview(Geometry=mesh, Material=swatch_3)  # disabled

T = StateGate(States=final_geometry)  # -> True, False
T_2 = StateGate(States=uv_space)  # -> True, False
T_3 = StateGate(States=scale_person)  # -> True, False
T_4 = StateGate(States=individual_connection)  # -> True, False

panel_7 = Panel("""x BETWEEN {0} AND {1} AND 
y BETWEEN {2} AND {3} AND 
z BETWEEN {4} AND {5} AND
 quality > {6} 
GROUP BY element_uuid
HAVING distance < {7} """)

toggle = CreateToggle(Default=False, Label="Query Database")
label_2 = CreateLabel(LabelText=" ", LabelSize="20", Justification="2")
merge_2 = Merge(Data1=toggle, Data2=label_2)
stack_2 = CreateStack(UIElements=merge_2, Horizontal=True)

rangeslider = CreateRangeSlider(SliderRange="0 to 100", StartingRange="0 to 100")
label_3 = CreateLabel(LabelText="Width Range", LabelSize=12, Justification=0)
merge_3 = Merge(Data1=label_3, Data2=rangeslider)

rangeslider_2 = CreateRangeSlider(SliderRange="0 to 100", StartingRange="0 to 100")
label_4 = CreateLabel(LabelText="Height Range", LabelSize=12, Justification=0)
merge_4 = Merge(Data1=label_4, Data2=rangeslider_2)

rangeslider_3 = CreateRangeSlider(SliderRange="0 to 10000", StartingRange="0 to 10000")
label_5 = CreateLabel(LabelText="Length Range", LabelSize=12, Justification=0)
merge_5 = Merge(Data1=label_5, Data2=rangeslider_3)

# ----
# Reposition Surface
srf = Surface(cluster)
pi = Pi(Factor="0.25")
rotate = Rotate(Geometry=srf, Angle=pi, Plane=PlaneXY(0, 0, 0))  # -> Geometry, Transform
flip = Flip(Surface=rotate.Geometry)  # -> Surface, Result
movetoplane = MoveToPlane(Geometry=flip.Surface, Plane=PlaneXY(0, 0, 0), Above=True, Below=True)  # -> Geometry, Transform
center = Center(Geometric=movetoplane.Geometry)  # -> Center, Dimension
pt = ConstructPoint(XCoordinate=0, YCoordinate=Slider(0, range=0..1000000), ZCoordinate=0)
scale = Scale(Geometry=movetoplane.Geometry, Center=center.Center, Factor=Slider(1, range=0..3))  # -> Geometry, Transform
move = Move(Geometry=scale.Geometry, Motion=pt)  # -> Geometry, Transform

srf_2 = Surface(reparameterize(move.Geometry))

srf_design_surface = RemoteSender(srf_2)

# ----
# Divide Surface
srf_design_surface_2 = RemoteReceiver(srf_design_surface)
number_slider_6 = Slider(12, range=5..12)
number_slider_7 = Slider(6, range=5..10)
number_slider_8 = Slider(2, range=0..10)
hexdivide = HexDivide(
    Surface=srf_design_surface_2,
    U=number_slider_6,
    V=number_slider_7,
    Parameter=Slider(0, range=0..1),
    Boundary=0,
    Swap=True,
    Rebuild=Slider(1, range=0..1),
    Quadrangulate=False,
    Divisions=True,
    Explode=False)  # -> Mesh, DistA, DistB
mesh_design_mesh = RemoteSender(hexdivide.Mesh)

# ----
# Create Design Elements
# Find Element Directions
mesh_design_mesh_2 = RemoteReceiver(mesh_design_mesh)
recipricaledges = RecipricalEdges(Mesh=mesh_design_mesh_2, Angle="0", Scale="1", NormalType=True)  # -> Curve, flatten(ID0), flatten(ID1), Vectors
crv = Curve(recipricaledges.Curve)
end = EndPoints(Curve=crv)  # -> Start, End
entwine_2 = Entwine(Branch00=end.Start, Branch01=end.End, FlattenInputs=True)
srf_design_surface_3 = RemoteReceiver(srf_design_surface)
flip_2 = FlipMatrix(Data=entwine_2)
srf_cp = SurfaceClosestPoint(Point=flip_2, Surface=srf_design_surface_3)  # -> Point, UVPoint, Distance
item_3 = ListItem(List=srf_cp.UVPoint, Index=0, Wrap=True)  # -> Item, Item1
subtraction = Subtraction(A=item_3.Item1, B=item_3.Item)
pdecon = Deconstruct(Point=subtraction)  # -> XComponent, YComponent, ZComponent
ln = Line(StartPoint=item_3.Item, EndPoint=item_3.Item1)
expression = Expression(x=pdecon.XComponent, Expression="x / abs(x)")
expression_2 = Expression(x=pdecon.YComponent, Expression="x / abs(x)")
equals = Equality(FirstNumber=expression, SecondNumber=expression_2)  # -> Equality, Inequality
line_uv_space_design = RemoteSender(ln)
bool_direction = RemoteSender(equals.Equality)

# ----
# Extract Connection Curves
crv_curve_initial = RemoteReceiver()
bool_direction_2 = RemoteReceiver(bool_direction)
dispatch = Dispatch(List=flatten(crv_curve_initial), DispatchPattern=flatten(bool_direction_2))  # -> ListA, ListB
crv_2 = Curve(reparameterize(dispatch.ListA))
crv_3 = Curve(reparameterize(dispatch.ListB))
llx = LineLine(Line1=graft(crv_2), Line2=crv_3)  # -> simplify(ParamA), simplify(ParamB), simplify(PointA), simplify(PointB)
dist = Distance(PointA=llx.PointA, PointB=llx.PointB)
smaller = SmallerThan(FirstNumber=dist, SecondNumber=Slider(0.175, range=0..1))  # -> SmallerThan, OrEqualTo
inc = Includes(Value=llx.ParamA, Domain="0 to 1")  # -> Includes, Deviation
inc_2 = Includes(Value=llx.ParamB, Domain="0 to 1")  # -> Includes, Deviation
and = GateAnd(A=inc.Includes, C=inc_2.Includes, B=smaller.SmallerThan)
ln_2 = Line(StartPoint=llx.PointA, EndPoint=llx.PointB)
dispatch_2 = Dispatch(List=ln_2, DispatchPattern=and)  # -> ListA, ListB
pt_2 = Point(llx.PointA)
pt_3 = Point(llx.PointB)
dispatch_3 = Dispatch(List=pt_2, DispatchPattern=and)  # -> ListA, ListB
dispatch_4 = Dispatch(List=pt_3, DispatchPattern=and)  # -> ListA, ListB
crv_4 = Curve(dispatch_2.ListA)
pt_4 = Point(dispatch_3.ListA)
pt_5 = Point(dispatch_4.ListA)
crv_connections_initial = RemoteSender(crv_4)

panel_8 = Panel("""Matched
Matched after cut""")
panel_9 = Panel("""50
50""")
chart = CreateChart(Data=panel_9, Names=panel_8, Title="Fully Matched Items", ChartType=2)
color_found_item_3 = RemoteReceiver(color_found_item)
chartappearance = ChartAppearance(ChartToModify=chart, Colors=[color_found_item_3, ColourSwatch(SwatchColor=RGB(158, 158, 158))])

merge_6 = Merge(
    Data1=merge_5,
    Data2=merge_3,
    Data3=merge_4,
    Data4=label,
    Data5=slider_2,
    Data6=slider,
    Data7=stack,
    Data8=separator,
    Data9=stack_2,
    Data10=chart)

# ---- group: UI Core
panel_10 = Panel("Database Parameters")
toggle_2 = BooleanToggle(False)
data_elements = Data(merge_6)

# ----
launchwin = LaunchWindow(Show=toggle_2, Name=panel_10, Width=370, Height=400, ChildStatus=0, EnableHorizScroll=False)

# ---- group: UI Core (continued)
addelems = AddElements(Window=launchwin, Elements=flatten(data_elements), DoVLChecking=True)  # -> AddedElements, ElementNames
values = ValueListener(Elements=addelems.AddedElements, SomeProperty=True)  # -> Values, Indices
item_4 = ListItem(List=flatten(values.Values), Index=0, Wrap=True)  # -> Item, Item1, Item2, Item3, Item4, Item5, Item6, Item7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
num_maximum_distance = RemoteSender(item_4.Item8)
boolean_query_database = RemoteSender(item_4.Item12)
num_min_quality = RemoteSender(item_4.Item7)
domain_length = RemoteSender(item_4.Item1)
domain_height = RemoteSender(item_4.Item5)
num_site_long = RemoteSender(item_4.Item10)
domain_width = RemoteSender(item_4.Item3)
num_site_lat = RemoteSender(item_4.Item9)

# ----
# Database GUI
domain_length_2 = RemoteReceiver(domain_length)
dedomain = DeconstructDomain(Domain=domain_length_2)  # -> Start, End
expression_3 = Expression(x=dedomain.Start, Expression="round(x * 100) / 100")
expression_4 = Expression(x=dedomain.End, Expression="round(x * 100) / 100")
format_2 = Format(Format="Length Range : ({0} : {1})", Culture=127, Data0=expression_3, Data1=expression_4)
setlabel = SetLabelContents(LabelToModify=label_5, NewLabelContents=format_2)

domain_height_2 = RemoteReceiver(domain_height)
dedomain_2 = DeconstructDomain(Domain=domain_height_2)  # -> Start, End
expression_5 = Expression(x=dedomain_2.Start, Expression="round(x * 100) / 100")
expression_6 = Expression(x=dedomain_2.End, Expression="round(x * 100) / 100")
format_3 = Format(Format="Height Range : ({0} : {1})", Culture=127, Data0=expression_5, Data1=expression_6)
setlabel_2 = SetLabelContents(LabelToModify=label_4, NewLabelContents=format_3)

domain_width_2 = RemoteReceiver(domain_width)
dedomain_3 = DeconstructDomain(Domain=domain_width_2)  # -> Start, End
expression_7 = Expression(x=dedomain_3.Start, Expression="round(x * 100) / 100")
expression_8 = Expression(x=dedomain_3.End, Expression="round(x * 100) / 100")
format_4 = Format(Format="Width Range : ({0} : {1})", Culture=127, Data0=expression_7, Data1=expression_8)
setlabel_3 = SetLabelContents(LabelToModify=label_3, NewLabelContents=format_4)

domain_length_3 = RemoteReceiver(domain_length)
domain_height_3 = RemoteReceiver(domain_height)
domain_width_3 = RemoteReceiver(domain_width)
num_maximum_distance_2 = RemoteReceiver(num_maximum_distance)
num_min_quality_2 = RemoteReceiver(num_min_quality)
num_site_long_2 = RemoteReceiver(num_site_long)
num_site_lat_2 = RemoteReceiver(num_site_lat)
dedomain_4 = DeconstructDomain(Domain=domain_width_3)  # -> Start, End
dedomain_5 = DeconstructDomain(Domain=domain_height_3)  # -> Start, End
dedomain_6 = DeconstructDomain(Domain=domain_length_3)  # -> Start, End
format_5 = Format(Format="*, (get_distance(lat,lng,{0},{1})) AS distance", Culture=127, Data0=num_site_lat_2, Data1=num_site_long_2)
format_6 = Format(
    Format=panel_7,
    Culture=127,
    Data0=dedomain_6.Start,
    Data1=dedomain_6.End,
    Data2=dedomain_4.Start,
    Data3=dedomain_4.End,
    Data4=dedomain_5.Start,
    Data5=dedomain_5.End,
    Data6=num_min_quality_2,
    Data7=num_maximum_distance_2)

boolean_query_database_2 = RemoteReceiver(boolean_query_database)
querysfw = SQLSELECTString(Select=format_5, From="real_elements", Where=format_6, Connector="MySQL")
panel_11 = Panel(querysfw)
query = RDBMSQuery(ConnectString=format, ConnectToggle=boolean_query_database_2, RDBMSQuery=querysfw, Connector="MySQL")  # -> Exceptions, TableHeadings, TableData
flip_3 = FlipMatrix(Data=query.TableData)
tstat = TreeStatistics(Tree=flip_3)  # -> Paths, Length, Count
dam = DataDam(DataA=flip_3, BufferDelay=10000000, BufferMode=1)
python = GhPythonScript(n=tstat.Count)  # -> a
# ---------- python: Python ----------
__author__ = "matt"
__version__ = "2020.04.26"

import rhinoscriptsyntax as rs

if n == None:
    a = "0"
else:
    a = n
# ---------- end python ----------
item_5 = ListItem(List=simplify(dam), Index=0, Wrap=True)  # -> flatten(Item), flatten(Item1), flatten(Item2), flatten(Item3), flatten(Item4), flatten(Item5), flatten(Item6), flatten(Item7), flatten(Item8)
num_db_item_count = RemoteSender(python)
num_7 = Number(item_5.Item1)
num_8 = Number(item_5.Item7)
num_9 = Number(item_5.Item8)
txt_2 = Text(item_5.Item)
num_10 = Number(item_5.Item2)
num_11 = Number(item_5.Item3)
num_12 = Number(item_5.Item4)
txt_3 = Text(item_5.Item5)
num_13 = Number(item_5.Item6)
items_quality = RemoteSender(num_12)
items_species = RemoteSender(txt_3)
items_distance = RemoteSender(num_9)
items_uuids = RemoteSender(txt_2)
division = Division(A=num_7, B=1000)
division_2 = Division(A=num_10, B=1000)
division_3 = Division(A=num_11, B=1000)
items_y = RemoteSender(division_2)
database = RemoteSender(division)
items_z = RemoteSender(division_3)

num_db_item_count_2 = RemoteReceiver(num_db_item_count)
format_7 = Format(Format="        Items : {0}", Culture=127, Data0=num_db_item_count_2)
setlabel_4 = SetLabelContents(LabelToModify=label_2, NewLabelContents=format_7)

winprops = SetWindowProperties(
    Window=launchwin,
    Theme=1,
    AccentColor="orange",
    ShowTitleBar=invert(Toggle(False)),
    BackgroundColor=swatch,
    ScaleFactor=1)
adjustelem = AdjustElementAppearance(ElementsToAdjust=data_elements, Foreground=ColourSwatch(SwatchColor=RGB(87, 87, 87)), FontSize=Slider(10, range=0..100))

adjustpos = AdjustElementPositioning(ElementsToAdjust=data_elements, Margin="0,7,0,7", AbsolutePositioning=False)
items_uuids_2 = RemoteReceiver(items_uuids)
items_y_2 = RemoteReceiver(items_y)
items_z_2 = RemoteReceiver(items_z)
database_2 = RemoteReceiver(database)
rectangle = Rectangle(Plane=PlaneXY(0, 0, 0), XSize=items_y_2, YSize=items_z_2, Radius=0)  # -> Rectangle, Length
boxrec = BoxRectangle(Rectangle=rectangle.Rectangle, Height=database_2)

mesh_design_mesh_3 = RemoteReceiver(mesh_design_mesh)
center_2 = Center(Geometric=mesh_design_mesh_3)  # -> Center, Dimension
cir = Circle(Plane=center_2.Center, Radius=Slider(4, range=0..10))
lng = ListLength(List=boxrec)
divide = DivideCurve(Curve=cir, Count=lng, Kinks=False)  # -> Points, Tangents, Parameters
center_3 = Center(Geometric=boxrec)  # -> Center, Dimension
move2pt = MoveToPoint(Geometry=boxrec, PointA=center_3.Center, PointB=divide.Points)  # -> Moved, Vector, Transform

visualize_mesh = RemoteSender(move2pt.Moved)

adjustelem_2 = AdjustElementAppearance(ElementsToAdjust=data_elements, Foreground=ColourSwatch(SwatchColor=RGB(150, 150, 150)), Background=swatch)

# ----
# Apply Reciprocal Rotation
number_slider_9 = Slider(0.25, range=0..1)
mesh_design_mesh_4 = RemoteReceiver(mesh_design_mesh)
deg = Degrees(Radians=number_slider_9)
recipricaledges_2 = RecipricalEdges(Mesh=mesh_design_mesh_4, Angle=number_slider_9, Scale=Slider(1.4, range=1..1.4), NormalType=True)  # -> Curve, flatten(ID0), flatten(ID1), Vectors
recipricalthickness = RecipricalThickness(Mesh=mesh_design_mesh_4, Angle=deg, Distance="0.045", Width="0.0225")
bool_direction_3 = RemoteReceiver(bool_direction)
panel_12 = Panel("""255,0,0
0,0,255""")
item_6 = ListItem(List=panel_12, Index=bool_direction_3, Wrap=True)
preview_3 = CustomPreview(Geometry=recipricaledges_2.Curve, Material=flatten(item_6))

path_mapper = PathMapper(recipricalthickness, source="{A}(i)", target="{path_index}(i)")

crv_fabrication_curves_raw = Curve(path_mapper)

# ----
# Extract Element Descriptors
crv_5 = Curve(crv_fabrication_curves_raw)
explode = Explode(Curve=crv_5, Recursive=True)  # -> Segments, Vertices
len = Length(Curve=explode.Segments)
sort = SortList(Keys=len, ValuesA=explode.Segments)  # -> Keys, ValuesA
item_7 = ListItem(List=sort.ValuesA, Index=0, Wrap=True)  # -> Item, Item1
eval = EvaluateCurve(Curve=reparameterize(item_7.Item), Parameter="0.5")  # -> Point, Tangent, Angle
eval_2 = EvaluateCurve(Curve=reparameterize(item_7.Item1), Parameter="0.5")  # -> Point, Tangent, Angle
trim = TrimTree(Tree=eval.Point, Depth=1)
trim_2 = TrimTree(Tree=eval_2.Point, Depth=1)
item_8 = ListItem(List=trim, Index=0, Wrap=True)  # -> Item, Item1
item_9 = ListItem(List=trim_2, Index=0, Wrap=True)  # -> Item, Item1
ln_3 = Line(StartPoint=item_8.Item, EndPoint=item_8.Item1)
ln_4 = Line(StartPoint=item_9.Item, EndPoint=item_9.Item1)
eval_3 = EvaluateCurve(Curve=ln_3, Parameter="0.5")  # -> Point, Tangent, Angle
eval_4 = EvaluateCurve(Curve=ln_4, Parameter="0.5")  # -> Point, Tangent, Angle
ln_5 = Line(StartPoint=eval_3.Point, EndPoint=eval_4.Point)
crv_6 = Curve(ln_5)
vec2pt = Vector2Pt(PointA=eval_3.Point, PointB=eval_4.Point, Unitize=False)  # -> Vector, Length
eval_5 = EvaluateCurve(Curve=crv_6, Parameter="0.5")  # -> Point, Tangent, Angle
pt_fabrication_centerpoints_raw = RemoteSender(eval_5.Point)
crv_fabrication_centerlines_raw = RemoteSender(crv_6)
vector_fabrication_vectors = RemoteSender(vec2pt.Vector)

# ----
# Create Element Meshes
panel_13 = Panel("""0
1""")
paramloftmsh = ParameterLoftMesh(
    Sections=crv_fabrication_curves_raw,
    ParametersU=[0, 0.1, 0.2, 0.3, 0.4, 0.5, 0.6, 0.7, 0.8, 0.9, 1],
    ParametersV=panel_13,
    Weighted=False,
    Lengths=False,
    Angle=0,
    Closed=False,
    Triangulate=False)
clsmsh = CloseMesh(Mesh=paramloftmsh, Quadrangulate=True)  # -> Closed, Amount, Openings, R
mesh_fabrication_mesh_raw = RemoteSender(clsmsh.Closed)

item_10 = ListItem(List=crv_fabrication_curves_raw, Index=0, Wrap=True)
srf_3 = Surface(item_10)
evalsrf = EvaluateSurface(Surface=srf_3, Point="0.5,0.5")  # -> Point, Normal, UDirection, VDirection, Frame
vec_raw_normals = RemoteSender(evalsrf.Normal)

# ----
# Scale Elements and Convert to Boxes
genes = GenePool(
    Decimals=2,
    Maximum=1.8,
    Minimum=1.2,
    Value=[1.250037829, 1.779385884, 1.715451997, 1.75774183, 1.346463016, 1.589064614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])
mesh_fabrication_mesh_raw_2 = RemoteReceiver(mesh_fabrication_mesh_raw)
pt_fabrication_centerpoints_raw_2 = RemoteReceiver(pt_fabrication_centerpoints_raw)
vector_fabrication_vectors_2 = RemoteReceiver(vector_fabrication_vectors)
crv_fabrication_centerlines_raw_2 = RemoteReceiver(crv_fabrication_centerlines_raw)
lng_2 = ListLength(List=flatten(pt_fabrication_centerpoints_raw_2))
data = Data(genes)
split_2 = SplitList(List=data, Index=lng_2)  # -> graft(ListA), ListB
pl = PlaneNormal(Origin=pt_fabrication_centerpoints_raw_2, ZAxis=vector_fabrication_vectors_2)
scale_nu = ScaleNU(Geometry=mesh_fabrication_mesh_raw_2, Plane=pl, ScaleX=1, ScaleY=1, ScaleZ=split_2.ListA)  # -> Geometry, Transform
scale_nu_2 = ScaleNU(Geometry=crv_fabrication_centerlines_raw_2, Plane=pl, ScaleX=1, ScaleY=1, ScaleZ=split_2.ListA)  # -> Geometry, Transform
vec_raw_normals_2 = RemoteReceiver(vec_raw_normals)
align = AlignPlane(Plane=pl, Direction=vec_raw_normals_2)  # -> Plane, Angle
bbox = BoundingBox(Content=scale_nu.Geometry, Plane=align.Plane)  # -> simplify(Box), Box_2
crv_fabrication_centerlines_scaled = RemoteSender(scale_nu_2.Geometry)
mesh_fabrication_mesh_scaled = RemoteSender(bbox.Box)

pl_2 = PlaneNormal(Origin=pt_fabrication_centerpoints_raw_2, ZAxis=vector_fabrication_vectors_2)
scale_nu_3 = ScaleNU(Geometry=bbox.Box, Plane=pl_2, ScaleX=1, ScaleY=1, ScaleZ=panel_4)  # -> Geometry, Transform
vec_raw_normals_3 = RemoteReceiver(vec_raw_normals)
align_2 = AlignPlane(Plane=pl_2, Direction=vec_raw_normals_3)  # -> Plane, Angle
bbox_2 = BoundingBox(Content=scale_nu_3.Geometry, Plane=align_2.Plane)  # -> simplify(Box), Box_2
mesh_fabrication_mesh_scaled_2 = RemoteSender(bbox_2.Box)

# ----
# Calculate Ideal Offsets
crv_connections_initial_2 = RemoteReceiver(crv_connections_initial)
mesh_design_mesh_5 = RemoteReceiver(mesh_design_mesh)
pt_fabrication_centerpoints_raw_3 = RemoteReceiver(pt_fabrication_centerpoints_raw)
bool_direction_4 = RemoteReceiver(bool_direction)
len_2 = Length(Curve=crv_connections_initial_2)
subtraction_2 = Subtraction(A=len_2, B="0.045")
dispatch_5 = Dispatch(List=flatten(pt_fabrication_centerpoints_raw_3), DispatchPattern=flatten(bool_direction_4))  # -> ListA, ListB
hilonums = HighestLowestNumbers(Numbers=subtraction_2)  # -> flatten(Highest), flatten(Lowest)
meshcp = MeshClosestPoint(Point=dispatch_5.ListA, Mesh=mesh_design_mesh_5)  # -> Point, Index, Parameter
meval = MeshEval(Mesh=mesh_design_mesh_5, Parameter=meshcp.Parameter)  # -> Point, Normal, Colour
max = Maximum(A=hilonums.Lowest, B="0.055")
amp = Amplitude(Vector=meval.Normal, Amplitude="0")
vdis = VectorDisplay(Anchor=meval.Point, Vector=amp)
# Reorient and Extract Fabrication Information
vec_stick_offsets_2 = RemoteSender(amp)

# ----
# Collate Ideal Offsets
bool_direction_5 = RemoteReceiver(bool_direction)
vec_stick_offsets_2_2 = RemoteReceiver(vec_stick_offsets_2)
lng_3 = ListLength(List=vec_stick_offsets_2_2)
repeat = RepeatData(Data="0,0,0", Length=lng_3)
entwine_3 = Entwine(Branch00=repeat, Branch01=vec_stick_offsets_2_2, FlattenInputs=True)
flip_4 = FlipMatrix(Data=entwine_3)
item_11 = ListItem(List=flip_4, Index=bool_direction_5, Wrap=True)  # -> simplify(Item)

# ----
# Database
number_slider_10 = Slider(1, range=0..10)

num_14 = Number(Slider(1, range=0..2))
num_15 = Number(Slider(2, range=0..2))

num_16 = Number("2")
visualize_mesh_2 = RemoteReceiver(visualize_mesh)
visualize_mesh_3 = RemoteReceiver(visualize_mesh)
visualize_mesh_4 = RemoteReceiver(visualize_mesh)
color_not_found_item_3 = RemoteReceiver(color_not_found_item)
color_found_item_4 = RemoteReceiver(color_found_item)
color_cut_item_3 = RemoteReceiver(color_cut_item)

number_slider_11 = Slider(10, range=0..100)
database_3 = RemoteReceiver(database)

sort_2 = SortList(Keys=database_3)  # -> Keys, ValuesA
rev = ReverseList(List=sort_2.Keys)

panel_14 = Panel("""0.25
0.5
0.75""")
vertical_points = RemoteReceiver()
line_support = RemoteReceiver()
l2_points = RemoteReceiver()
l3_points = RemoteReceiver()
l1_points = RemoteReceiver()
shatter = Shatter(Curve=reparameterize(vertical_points), Parameters=panel_14)  # -> flatten(Segments)
merge_7 = Merge(Data1=line_support, Data3=vertical_points, Data4=l1_points, Data5=l2_points, Data6=l3_points)
scale_2 = Scale(Geometry=merge_7, Center=Point(0, 0, 0), Factor=".001")  # -> flatten(Geometry), Transform
crv_7 = Curve(scale_2.Geometry)
end_2 = EndPoints(Curve=crv_7)  # -> Start, End
ln_6 = Line(StartPoint=end_2.Start, EndPoint=end_2.End)
panel_15 = Panel(".0501")

# ---- group: Attempts to cull unsupported elements
# Structural Analysis
panel_16 = Panel("int(x*10) / 10")  # disabled
panel_17 = Panel("1")  # disabled

# ----
# Calculate Simple Offsets
number_slider_12 = Slider(0.04, range=0..1)
bool_direction_6 = RemoteReceiver(bool_direction)
num_base_offset = Number(number_slider_12)
mesh_design_mesh_6 = RemoteReceiver(mesh_design_mesh)
pt_fabrication_centerpoints_raw_4 = RemoteReceiver(pt_fabrication_centerpoints_raw)
panel_18 = Panel("""1
-1""")
merge_8 = Merge(Data1=num_base_offset, Data2="0")
item_12 = ListItem(List=panel_18, Index=bool_direction_6, Wrap=True)
meshcp_2 = MeshClosestPoint(Point=pt_fabrication_centerpoints_raw_4, Mesh=mesh_design_mesh_6)  # -> Point, Index, Parameter
multiplication = Multiplication(A=num_base_offset, B=item_12)
item_13 = ListItem(List=merge_8, Index=bool_direction_6, Wrap=True)
meval_2 = MeshEval(Mesh=mesh_design_mesh_6, Parameter=meshcp_2.Parameter)  # -> Point, Normal, Colour
addition = Addition(A=multiplication, B=item_13)

# ----
# Manually Offset Problem Elements
bool_direction_7 = RemoteReceiver(bool_direction)
int_bad_real = Integer([1, 3, 5, 6, 7, 10])
repeat_2 = RepeatData(Data="0", Length="36")
replace = ReplaceItems(List=flatten(repeat_2), Item="-0.05", Wrap=False)
weave = Weave(Pattern=flatten(bool_direction_7), Stream0=repeat_2, Stream1=replace, NullGaps=False)  # -> graft(Weave)
addition_2 = Addition(A=weave, B=addition)

num_adjusted_offsets = Number(addition_2)
amp_2 = Amplitude(Vector=meval_2.Normal, Amplitude=num_adjusted_offsets)  # -> simplify(Vector)
vec_element_offsets = RemoteSender(amp_2)

# ----
# Apply Simple and Ideal Offsets
mesh_fabrication_mesh_scaled_3 = RemoteReceiver(mesh_fabrication_mesh_scaled)
vec_element_offsets_2 = RemoteReceiver(vec_element_offsets)
crv_fabrication_centerlines_scaled_2 = RemoteReceiver(crv_fabrication_centerlines_scaled)
move_2 = Move(Geometry=mesh_fabrication_mesh_scaled_3, Motion=vec_element_offsets_2)  # -> Geometry, Transform
move_3 = Move(Geometry=crv_fabrication_centerlines_scaled_2, Motion=vec_element_offsets_2)  # -> Geometry, Transform
move_4 = Move(Geometry=move_2.Geometry, Motion=item_11)  # -> Geometry, Transform
move_5 = Move(Geometry=move_3.Geometry, Motion=item_11)  # -> Geometry, Transform
crv_fabrication_centerlines_final = RemoteSender(move_5.Geometry)
mesh_fabrication_mesh_final = RemoteSender(move_4.Geometry)

crv_fabrication_centerlines_final_2 = RemoteReceiver(flatten(crv_fabrication_centerlines_final))

mesh_fabrication_mesh_final_2 = RemoteReceiver(mesh_fabrication_mesh_final)
cluster_3 = Cluster_2(crv=flatten(crv_fabrication_centerlines_final_2), i=number_slider_10, B=Slider(1, range=0..10))  # -> crv_4, int_2
len_3 = Length(Curve=cluster_3.crv_4)
design = RemoteSender(len_3)
mesh_fabrication_sorted = RemoteSender(flatten(mesh_fabrication_mesh_final_2))

mesh_fabrication_mesh_final_3 = RemoteReceiver(mesh_fabrication_mesh_final)
midpt = CurveMiddle(Curve=crv_fabrication_centerlines_final_2)
mesh_fabrication_sorted_2 = RemoteReceiver(mesh_fabrication_sorted)
mesh_fabrication_sorted_3 = RemoteReceiver(mesh_fabrication_sorted)
mesh_fabrication_sorted_4 = RemoteReceiver(mesh_fabrication_sorted)
frame = CurveFrame(Curve=crv_fabrication_centerlines_final_2, Parameter=midpt)
pl_origin = PlaneOrigin(Base=frame, Origin=midpt)
design_planes = RemoteSender(pl_origin)
lng_4 = ListLength(List=mesh_fabrication_sorted_2)
design_planes_2 = RemoteReceiver(design_planes)

design_planes_3 = RemoteReceiver(design_planes)
# Matching
design_2 = RemoteReceiver(design)
python_2 = GhPythonScript(design=design_2, database=database_3, planes=design_planes_3, tolerance=number_slider_11)  # -> out, cuts, output_lengths, output_planes, output_dbids, output_types, output_unmatched_count, design_ids; inputs design: list, database: list, planes: list of Plane; disabled
# ---------- python_2: Python ----------
# INPUTS
# design : dimensions of pieces described in design
# database : dimensions of pieces in database slice
# planes : center planes associated with design pieces
# tolerance : percentage a piece can be larger than design without needing to be cut


import rhinoscriptsyntax as rs
import ghpythonlib.components as gh

import bisect
import collections
import time

# === DECLARATIONS ===

output_lengths = []
output_planes = []
output_dbids = []
output_types = []


cuts = 0 # number of cuts

largest_db_value = 0

TYPE_FOUND = 0
TYPE_CUT = 1
TYPE_MISSING = 2

kerf_width = 0.003

# === DEFINITIONS ===

def millis():
    return int(round(time.time() * 1000))
    
def reverse_insort(a, x, concurrent_list = None, concurrent_item = None):
    """Insert item x in list a, and keep it reverse-sorted assuming a
    is reverse-sorted.

    If x is already in a, insert it to the right of the rightmost x.
    Doesn't use lo and hi arguments
    """
    lo = 0
    hi = len(a)
        
    while lo < hi:
        mid = (lo+hi)//2
        if x > a[mid]: 
            hi = mid
        else: 
            lo = mid+1
    a.insert(lo, x)
    if concurrent_list is not None:
        concurrent_list.insert(lo,concurrent_item)



# === MAIN SCRIPT ===

# Time at start of execution
time_start = millis()

# Sort the design elements by length, and reverse to put largest first
design_ids = gh.Series(0,1,len(design))
design,design_ids = gh.SortList(design,design_ids)
planes = gh.ListItem(planes,design_ids,True)
design.reverse()
planes.reverse()
design_ids.reverse()

# Do the same for the database, and create a listing of the original ids
database_ids = gh.Series(0,1,len(database))
database,database_ids = gh.SortList(database,database_ids)
database.reverse()
database_ids.reverse()

# Start largest available element
largest_db_value = database[0]

# Record time taken for sorting
time_sort = millis()
print("Sort time : %s" % (time_sort - time_start))



for design_id,design_length in enumerate(design):
    minimum_id = -1
    minimum = 10000000000
    minimum_id_to_cut = -1
    minimum_to_cut = 10000000000
    design_plus_tolerance = design_length + (design_length*(tolerance/100.))
    # If the item is bigger than the dataset, build of two parts
    if design_plus_tolerance > largest_db_value:
        new_length = design_length / 2
        #continue
    for item_id,item_length in enumerate(database):
        if item_length >= design_length:
            if item_length <= design_plus_tolerance:
                minimum = item_length
                minimum_id = item_id
            else:
                minimum_to_cut = item_length
                minimum_id_to_cut = item_id
        # If smaller, we're now below the usable range
        else:
           break

    # When it can't find any usable piece
    if minimum_id == -1 and minimum_id_to_cut == -1:
        output_lengths.append(design_length)
        output_types.append(TYPE_MISSING)
        output_dbids.append(-1)

    # When a cut happens
    elif minimum_id == -1:
        db_id = database_ids[minimum_id_to_cut]
        del database[minimum_id_to_cut]
        del database_ids[minimum_id_to_cut]
        
        output_lengths.append(design_length)
        output_types.append(TYPE_CUT)
        output_dbids.append(db_id)
        cutoff_length = minimum_to_cut - design_length - kerf_width
        reverse_insort(database,cutoff_length,database_ids,db_id)
        cuts = cuts + 1

    # When it finds a usable piece that doens't need cuts
    else:
        db_id = database_ids[minimum_id]
        del database[minimum_id]
        del database_ids[minimum_id]
        output_lengths.append(minimum)
        output_types.append(TYPE_FOUND)
        output_dbids.append(db_id)
        
    output_planes.append(planes[design_id])
    
time_end = millis()

output_unmatched_count = output_types.count(2)

print("Match time : %s" % (time_end - time_sort))

print("Fully Matched Items: %s" % output_types.count(0))
print("Matches After Cut: %s" % output_types.count(1))
print("Unmatched Items: %s" % output_unmatched_count)
print("Unused Database Items : %s" % len(database))
# ---------- end python_2 ----------
# length of design pieces
found_item = RemoteSender(python_2.design_ids)
int_cut_count = RemoteSender(python_2.cuts)
int_output_dbids = RemoteSender(python_2.output_dbids)
num_output_planes = RemoteSender(python_2.output_planes)
int_output_types = RemoteSender(python_2.output_types)
num_output_lengths = RemoteSender(python_2.output_lengths)
int_output_unmatched_count = RemoteSender(python_2.output_unmatched_count)

int_output_dbids_2 = RemoteReceiver(int_output_dbids)
int_output_types_2 = RemoteReceiver(int_output_types)
int_output_dbids_3 = RemoteReceiver(int_output_dbids)
int_output_types_3 = RemoteReceiver(int_output_types)
int_output_dbids_4 = RemoteReceiver(int_output_dbids)
int_output_types_4 = RemoteReceiver(int_output_types)
equals_2 = Equality(FirstNumber=int_output_dbids_2, SecondNumber="-1")  # -> Equality, Inequality
equals_3 = Equality(FirstNumber=int_output_types_2, SecondNumber="0")  # -> Equality, Inequality
equals_4 = Equality(FirstNumber=int_output_dbids_3, SecondNumber="-1")  # -> Equality, Inequality
equals_5 = Equality(FirstNumber=int_output_types_3, SecondNumber="1")  # -> Equality, Inequality
int_output_dbids_5 = RemoteReceiver(int_output_dbids)
equals_6 = Equality(FirstNumber=int_output_dbids_4, SecondNumber="-1")  # -> Equality, Inequality
equals_7 = Equality(FirstNumber=int_output_types_4, SecondNumber=num_16)  # -> Equality, Inequality
int_output_dbids_6 = RemoteReceiver(int_output_dbids)
int_output_dbids_7 = RemoteReceiver(int_output_dbids)
and_2 = GateAnd(A=equals_2.Inequality, B=equals_3.Equality)
and_3 = GateAnd(A=equals_4.Inequality, B=equals_5.Equality)
and_4 = GateAnd(A=equals_6.Inequality, B=equals_7.Equality)
cull = CullPattern(List=int_output_dbids_5, CullPattern=and_2)
cull_2 = CullPattern(List=int_output_dbids_6, CullPattern=and_3)
cull_3 = CullPattern(List=int_output_dbids_7, CullPattern=and_4)
item_14 = ListItem(List=visualize_mesh_2, Index=cull, Wrap=True)
item_15 = ListItem(List=visualize_mesh_3, Index=cull_2, Wrap=True)
item_16 = ListItem(List=visualize_mesh_4, Index=cull_3, Wrap=True)
preview_4 = CustomPreview(Geometry=item_14, Material=color_found_item_4)
preview_5 = CustomPreview(Geometry=item_15, Material=color_cut_item_3)
preview_6 = CustomPreview(Geometry=item_16, Material=color_not_found_item_3)
center_4 = Center(Geometric=item_14)  # -> Center, Dimension

int_output_types_5 = RemoteReceiver(int_output_types)
num_17 = Number(int_output_types_5)
mindex = MemberIndex(Set=num_17, Member=num)  # -> Index, Count

int_output_types_6 = RemoteReceiver(int_output_types)
int_output_types_7 = RemoteReceiver(int_output_types)
num_18 = Number(int_output_types_6)
num_19 = Number(int_output_types_7)
mindex_2 = MemberIndex(Set=num_18, Member=num_14)  # -> Index, Count
mindex_3 = MemberIndex(Set=num_19, Member=num_15)  # -> Index, Count
item_17 = ListItem(List=flatten(mesh_fabrication_sorted_2), Index=mindex.Index, Wrap=True)
item_18 = ListItem(List=flatten(mesh_fabrication_sorted_3), Index=mindex_2.Index, Wrap=True)
item_19 = ListItem(List=flatten(mesh_fabrication_sorted_4), Index=mindex_3.Index, Wrap=True)
preview_7 = CustomPreview(Geometry=item_17, Material=color_found_item_2)
preview_8 = CustomPreview(Geometry=item_18, Material=color_cut_item_2)
preview_9 = CustomPreview(Geometry=item_19, Material=color_not_found_item_2)

int_output_types_8 = RemoteReceiver(int_output_types)
lng_5 = ListLength(List=item_17)
cluster_4 = Cluster_4(A=lng_5, L=int_output_types_8)
setchart = SetChartContents(ChartToModify=chart, NewChartValues=cluster_4)

lng_6 = ListLength(List=item_17)
division_4 = Division(A=lng_6, B=lng_4)
multiplication_2 = Multiplication(A=division_4, B=100)
num_20 = Number(multiplication_2)
panel_19 = Panel(num_20)
center_5 = Center(Geometric=item_17)  # -> Center, Dimension
ln_7 = Line(StartPoint=center_4.Center, EndPoint=center_5.Center)
item_20 = ListItem(List=items_uuids_2, Index=cull, Wrap=True)
item_21 = ListItem(List=design_planes_2, Index=mindex.Index, Wrap=True)
dash = DashPattern(Curve=ln_7, Pattern=Slider(0.1, range=0..1))  # -> Dashes, Gaps
previewlw = CustomPreviewLineweights(Geometry=dash.Dashes, Shader=ColourSwatch(SwatchColor=RGB(66, 66, 66)), Absolute=False)
tag = TextTag3D(
    Location=item_21,
    Text=item_20,
    Size=Slider(0.02, range=0..0.1),
    Colour=ColourSwatch(SwatchColor=RGB(255, 255, 255)),
    Justification=5)
sort_3 = SortList(Keys=design_2)  # -> Keys, ValuesA
sort_4 = SortList(Keys=design_2)  # -> Keys, ValuesA
rev_2 = ReverseList(List=sort_3.Keys)
rev_3 = ReverseList(List=sort_4.Keys)
graph = QuickGraph([rev_3, rev], SortOrder=0)
graph_2 = QuickGraph([num_output_lengths, rev_2], SortOrder=0)
panel_20 = Panel(python_2.out)
crv_fabrication_centerlines_final_3 = RemoteReceiver(crv_fabrication_centerlines_final)

# ----
# Extract Connection Curves
crv_fabrication_centerlines_final_4 = RemoteReceiver(crv_fabrication_centerlines_final)
bool_direction_8 = RemoteReceiver(bool_direction)
dispatch_6 = Dispatch(List=flatten(crv_fabrication_centerlines_final_4), DispatchPattern=flatten(bool_direction_8))  # -> ListA, ListB
crv_8 = Curve(reparameterize(dispatch_6.ListA))
crv_9 = Curve(reparameterize(dispatch_6.ListB))
llx_2 = LineLine(Line1=graft(crv_8), Line2=crv_9)  # -> simplify(ParamA), simplify(ParamB), simplify(PointA), simplify(PointB)
dist_2 = Distance(PointA=llx_2.PointA, PointB=llx_2.PointB)
smaller_2 = SmallerThan(FirstNumber=dist_2, SecondNumber=Slider(0.175, range=0..1))  # -> SmallerThan, OrEqualTo
inc_3 = Includes(Value=llx_2.ParamA, Domain="0 to 1")  # -> Includes, Deviation
inc_4 = Includes(Value=llx_2.ParamB, Domain="0 to 1")  # -> Includes, Deviation
and_5 = GateAnd(A=inc_3.Includes, C=inc_4.Includes, B=smaller_2.SmallerThan)
ln_8 = Line(StartPoint=llx_2.PointA, EndPoint=llx_2.PointB)
dispatch_7 = Dispatch(List=ln_8, DispatchPattern=and_5)  # -> ListA, ListB
int = Integer(and_5)
int_2 = Integer("1")
mindex_4 = MemberIndex(Set=int, Member=int_2)  # -> simplify(Index), Count
crv_10 = Curve(dispatch_7.ListA)
int_connection_mapping = RemoteSender(mindex_4.Index)
bool_top_layer_matches = RemoteSender(and_5)
crv_connections = RemoteSender(crv_10)

crv_connections_2 = RemoteReceiver(crv_connections)
merge_9 = Merge(Data1=crv_fabrication_centerlines_final_3, Data2=crv_connections_2)  # -> flatten(Result)

llinter = LineLineIntersectionKaramba3D(Line=crv_fabrication_centerlines_final_3, LimitDistance_m=Slider(1, range=0..1))  # -> IntersectionPoints, flatten(LineSubSegements)

# ---- group: Attempts to cull unsupported elements (continued)
end_3 = EndPoints(Curve=llinter.LineSubSegements)  # -> Start, End; disabled
pdecon_2 = Deconstruct(Point=end_3.Start)  # -> XComponent, YComponent, ZComponent; disabled
pdecon_3 = Deconstruct(Point=end_3.End)  # -> XComponent, YComponent, ZComponent; disabled
eval_6 = Evaluate(F=panel_16, x=pdecon_2.XComponent)  # disabled
eval_7 = Evaluate(F=panel_16, x=pdecon_2.YComponent)  # disabled
eval_8 = Evaluate(F=panel_16, x=pdecon_2.ZComponent)  # disabled
eval_9 = Evaluate(F=panel_16, x=pdecon_3.XComponent)  # disabled
eval_10 = Evaluate(F=panel_16, x=pdecon_3.YComponent)  # disabled
eval_11 = Evaluate(F=panel_16, x=pdecon_3.ZComponent)  # disabled
pt_6 = ConstructPoint(XCoordinate=eval_6, YCoordinate=eval_7, ZCoordinate=eval_8)  # disabled
pt_7 = ConstructPoint(XCoordinate=eval_9, YCoordinate=eval_10, ZCoordinate=eval_11)  # disabled
merge_10 = Merge(Data1=pt_6, Data2=pt_7)  # disabled
mindex_5 = MemberIndex(Set=merge_10, Member=pt_6)  # -> Index, Count; disabled
mindex_6 = MemberIndex(Set=merge_10, Member=pt_7)  # -> Index, Count; disabled
larger = LargerThan(FirstNumber=mindex_5.Count, SecondNumber=panel_17)  # -> LargerThan, OrEqualTo; disabled
larger_2 = LargerThan(FirstNumber=mindex_6.Count, SecondNumber=panel_17)  # -> LargerThan, OrEqualTo; disabled
and_6 = GateAnd(A=larger.LargerThan, B=larger_2.LargerThan)  # disabled
dispatch_8 = Dispatch(List=llinter.LineSubSegements, DispatchPattern=and_6)  # -> ListA, ListB; disabled
crv_11 = Curve(dispatch_8.ListA)  # disabled

# ----
crv_12 = Curve(merge_9)
dam_2 = DataDam(DataA=crv_12, BufferDelay=10000000, BufferMode=0)

# ---- group: Find Suport Points
end_4 = EndPoints(Curve=dam_2)  # -> Start, End
merge_11 = Merge(Data1=end_4.Start, Data2=end_4.End)  # -> flatten(Result)
pdecon_4 = Deconstruct(Point=merge_11)  # -> XComponent, YComponent, ZComponent
eval_12 = EvaluateCurve(Curve=reparameterize(dam_2), Parameter="0.5")  # -> Point, Tangent, Angle
bnd = Bounds(Numbers=pdecon_4.ZComponent)
end_5 = EndPoints(Curve=dam_2)  # -> Start, End
pdecon_5 = Deconstruct(Point=eval_12.Point)  # -> XComponent, YComponent, ZComponent
dedomain_7 = DeconstructDomain(Domain=bnd)  # -> Start, End
bnd_2 = Bounds(Numbers=pdecon_5.YComponent)
similar = Similarity(FirstNumber=pdecon_4.ZComponent, SecondNumber=dedomain_7.End, Threshold=number_slider_4)  # -> Similarity, AbsoluteDifference
similar_2 = Similarity(FirstNumber=pdecon_4.ZComponent, SecondNumber=dedomain_7.Start, Threshold=number_slider_4)  # -> Similarity, AbsoluteDifference
merge_12 = Merge(Data1=graft(end_5.Start), Data2=graft(end_5.End))
dedomain_8 = DeconstructDomain(Domain=bnd_2)  # -> Start, End
flip_5 = FlipMatrix(Data=merge_12)
dispatch_9 = Dispatch(List=merge_11, DispatchPattern=similar.Similarity)  # -> ListA, ListB
dispatch_10 = Dispatch(List=merge_11, DispatchPattern=similar_2.Similarity)  # -> ListA, ListB
similar_3 = Similarity(FirstNumber=pdecon_5.YComponent, SecondNumber=dedomain_8.End, Threshold=0.1)  # -> Similarity, AbsoluteDifference
dispatch_11 = Dispatch(List=flip_5, DispatchPattern=similar_3.Similarity)  # -> ListA, ListB
merge_13 = Merge(Data1=dispatch_10.ListA)  # -> flatten(Result)

# ----
mesh_fabrication_mesh_scaled_2_2 = RemoteReceiver(mesh_fabrication_mesh_scaled_2)  # disabled
move_6 = Move(Geometry=mesh_fabrication_mesh_scaled_2_2, Motion=vec_element_offsets_2)  # -> Geometry, Transform; disabled
edges = BrepEdges(Brep=move_6.Geometry)  # -> Naked, Interior, NonManifold; disabled
swatch_4 = ColourSwatch(SwatchColor=RGB(255, 170, 0))  # disabled
swatch_5 = ColourSwatch(SwatchColor=RGB(120, 92, 62))  # disabled
preview_10 = CustomPreview(Geometry=edges.Interior, Material=swatch_4)  # disabled
preview_11 = CustomPreview(Geometry=mesh_fabrication_mesh_final, Material=swatch_5)  # disabled

matselect = MaterialSelectionKaramba3D(menu=[dropdown(4), dropdown(1)])
cross_section = CrossSectionKaramba3D(
    FamilyNameOfCrossSection="DefaultCroSec",
    Material=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,
    Height_cm=number_slider_5,
    UpperFlangeWidth_cm=number_slider_5,
    LowerFlangeWidth_cm=number_slider_5,
    mode="Trapezoid")
pt_8 = Point(merge_13)
supp = SupportKaramba3D(PosInd=pt_8, menu=[buttons(on, on, on, on, on, on)])
linetobeam = LineToBeamKaramba3D(Line=flatten(dam_2), CrossSection=cross_section, New=True, Remove=True, LimitDistance_m=0.005)  # -> Element, Points, Info
loads = LoadsKaramba3D(Vector=Vector(0, 0, -1), LCase=0, mode="Gravity")
assemble = AssembleModelKaramba3D(Elem=flatten(linetobeam.Element), Support=flatten(supp), Load=flatten(loads), LimitDistance_m=0.005)  # -> Model, Info, Mass_kg, CenterOfGravity
analyze = AnalyzeKaramba3D(Model=assemble.Model)  # -> CalculatedModel, MaximumDisplacement_cm, ResultingForceOfGravity_kN, ElasticEnergy_kNm
modelview = ModelViewKaramba3D(Model=analyze.CalculatedModel, ResultFactors=1, ResultCase=-1)  # -> Model, DeformedMesh, DeformedAxes, DeformedModel
num_max_displacement = RemoteSender(analyze.MaximumDisplacement_cm)
beamview = BeamViewKaramba3D(Model=modelview.Model)  # -> Model, MeshesOfRenderedBeams, DeformedBeamAxes, LegendColors, LegendTags
legend = Legend(Colour=beamview.LegendColors, Tags=beamview.LegendTags, LegendType=1)

# ----
# Extract Connection Planes
vector_fabrication_vectors_3 = RemoteReceiver(vector_fabrication_vectors)
bool_direction_9 = RemoteReceiver(bool_direction)
vec_raw_normals_4 = RemoteReceiver(vec_raw_normals)
bool_direction_10 = RemoteReceiver(bool_direction)
crv_connections_3 = RemoteReceiver(crv_connections)
int_connection_mapping_2 = RemoteReceiver(int_connection_mapping)
crv_fabrication_centerlines_final_5 = RemoteReceiver(crv_fabrication_centerlines_final)
bool_direction_11 = RemoteReceiver(bool_direction)
dispatch_12 = Dispatch(List=flatten(vec_raw_normals_4), DispatchPattern=flatten(bool_direction_10))  # -> flatten(ListA), flatten(ListB)
dispatch_13 = Dispatch(List=flatten(crv_fabrication_centerlines_final_5), DispatchPattern=flatten(bool_direction_11))  # -> flatten(ListA), flatten(ListB)
dispatch_14 = Dispatch(List=flatten(vector_fabrication_vectors_3), DispatchPattern=flatten(bool_direction_9))  # -> ListA, ListB
end_6 = EndPoints(Curve=crv_connections_3)  # -> Start, End
item_22 = ListItem(List=dispatch_14.ListB, Index=int_connection_mapping_2, Wrap=True)  # -> simplify(Item)
item_23 = ListItem(List=dispatch_12.ListB, Index=int_connection_mapping_2, Wrap=True)  # -> simplify(Item)
item_24 = ListItem(List=dispatch_14.ListB, Index=int_connection_mapping_2, Wrap=True)  # -> simplify(Item)
item_25 = ListItem(List=dispatch_13.ListB, Index=int_connection_mapping_2, Wrap=True)  # -> simplify(Item)
pl_3 = ConstructPlane(Origin=end_6.Start, XAxis=graft(dispatch_14.ListA), YAxis=graft(dispatch_12.ListA))
pl_4 = ConstructPlane(Origin=end_6.End, XAxis=item_22, YAxis=item_23)
rot3d = Rotate3D(Geometry=pl_3, Angle=expr("-0.5 * PI", 1.570796327), Center=end_6.Start, Axis=graft(dispatch_14.ListA))  # -> simplify(Geometry), Transform
rot3d_2 = Rotate3D(Geometry=pl_4, Angle=expr("0.5 * PI", 1.570796327), Center=end_6.End, Axis=item_24)  # -> Geometry, Transform
orient = Orient(Geometry=rot3d_2.Geometry, Source=rot3d.Geometry, Target=PlaneXY(0, 0, 0))  # -> Geometry, Transform
pln_base_element_start_plane = RemoteSender(rot3d.Geometry)
pln_top_element_start_plane = RemoteSender(rot3d_2.Geometry)
pln_top_element_end_plane = RemoteSender(orient.Geometry)
crv_centerlines_secondary = RemoteSender(item_25)

utilization = UtilizationOfElementsKaramba3D(
    AnalyzedModel=beamview.Model,
    ResultCase=-1,
    NumberOfSamplePoints=3,
    ElasticDesign=True,
    GammaM0=1,
    GammaM1=1,
    WithDetails=False,
    mode="Beams")  # -> AnalyzedModel, Utilization, SigMax_kN_cm2, SigMin_kN_cm2, TauMax_kN_cm2, UtilN, UtilVy, UtilVz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
beamdisp = BeamDisplacementsKaramba3D(AnalyzedModel=beamview.Model, LoadCase=-1, MaximumDistanceBetweenResults_m=-1, NumberOfResultsPerElement=2)  # -> AnalyzedModel, Translations_m, Rotations_rad
vlen = VectorLength(Vector=flatten(beamdisp.Translations_m))
bnd_3 = Bounds(Numbers=utilization.Utilization)
dedomain_9 = DeconstructDomain(Domain=bnd_3)  # -> Start, End
ma = MassAddition(Input=vlen)  # -> Result, PartialResults
panel_21 = Panel(ma.Result)
panel_22 = Panel(dedomain_9.End)
num_total_displacement = RemoteSender(ma.Result)
num_max_utilization = RemoteSender(dedomain_9.End)

# ----
# Structure Elements by Connection Tree
crv_connections_4 = RemoteReceiver(crv_connections)
bool_direction_12 = RemoteReceiver(bool_direction)
mesh_fabrication_mesh_final_4 = RemoteReceiver(mesh_fabrication_mesh_final)
int_connection_mapping_3 = RemoteReceiver(int_connection_mapping)
dispatch_15 = Dispatch(List=flatten(mesh_fabrication_mesh_final_4), DispatchPattern=flatten(bool_direction_12))  # -> graft(ListA), ListB
lng_7 = ListLength(List=crv_connections_4)
repeat_3 = RepeatData(Data=dispatch_15.ListA, Length=lng_7)  # -> simplify(Data)
item_26 = ListItem(List=dispatch_15.ListB, Index=int_connection_mapping_3, Wrap=True)  # -> simplify(Item)

# ----
# Reorient and Select Single
pln_base_element_start_plane_2 = RemoteReceiver(pln_base_element_start_plane)
pln_top_element_start_plane_2 = RemoteReceiver(simplify(pln_top_element_start_plane))
pln_base_element_start_plane_3 = RemoteReceiver(pln_base_element_start_plane)
pln_base_element_start_plane_4 = RemoteReceiver(pln_base_element_start_plane)
pln_base_element_start_plane_5 = RemoteReceiver(pln_base_element_start_plane)
pln_base_element_start_plane_6 = RemoteReceiver(pln_base_element_start_plane)
pln_base_element_start_plane_7 = RemoteReceiver(pln_base_element_start_plane)
pln_top_element_end_plane_2 = RemoteReceiver(simplify(pln_top_element_end_plane))
pln_top_element_start_plane_3 = RemoteReceiver(pln_top_element_start_plane)
pln_top_element_start_plane_4 = RemoteReceiver(pln_top_element_start_plane)
pln_base_element_start_plane_8 = RemoteReceiver(pln_base_element_start_plane)
pln_top_element_end_plane_3 = RemoteReceiver(pln_top_element_end_plane)
pln_top_element_end_plane_4 = RemoteReceiver(pln_top_element_end_plane)
crv_centerlines_secondary_2 = RemoteReceiver(crv_centerlines_secondary)
selected_connection = Slider(12, range=0..150)
crv_connections_5 = RemoteReceiver(crv_connections)
orient_2 = Orient(Geometry=repeat_3, Source=pln_base_element_start_plane_2, Target=PlaneXY(0, 0, 0))  # -> simplify(Geometry), Transform
orient_3 = Orient(Geometry=simplify(item_26), Source=simplify(pln_base_element_start_plane_3), Target=PlaneXY(0, 0, 0))  # -> Geometry, Transform
orient_4 = Orient(Geometry=crv_connections_5, Source=pln_base_element_start_plane_4, Target=PlaneXY(0, 0, 0))  # -> Geometry, Transform
orient_5 = Orient(Geometry=pln_base_element_start_plane_6, Source=pln_base_element_start_plane_6, Target=PlaneXY(0, 0, 0))  # -> Geometry, Transform
orient_6 = Orient(Geometry=pln_top_element_start_plane_2, Source=pln_top_element_start_plane_2, Target=pln_top_element_end_plane_2)  # -> Geometry, Transform
orient_7 = Orient(Geometry=end_6.Start, Source=pln_base_element_start_plane_8, Target=PlaneXY(0, 0, 0))  # -> Geometry, Transform
orient_8 = Orient(Geometry=pln_base_element_start_plane_5, Source=pln_base_element_start_plane_5, Target=PlaneXY(0, 0, 0))  # -> Geometry, Transform
orient_9 = Orient(Geometry=end_6.End, Source=pln_base_element_start_plane_7, Target=PlaneXY(0, 0, 0))  # -> Geometry, Transform
orient_10 = Orient(Geometry=pln_top_element_start_plane_3, Source=pln_top_element_start_plane_3, Target=pln_top_element_end_plane_3)  # -> Geometry, Transform
orient_11 = Orient(Geometry=crv_centerlines_secondary_2, Source=pln_top_element_start_plane_4, Target=pln_top_element_end_plane_4)  # -> Geometry, Transform
crv_connections_6 = RemoteReceiver(crv_connections)
pln_top_element_start_plane_5 = RemoteReceiver(simplify(pln_top_element_start_plane))
int_element_id = RemoteSender(selected_connection)
int_element_id_2 = RemoteReceiver(int_element_id)
int_element_id_3 = RemoteReceiver(int_element_id)
int_element_id_4 = RemoteReceiver(int_element_id)
int_element_id_5 = RemoteReceiver(int_element_id)
int_element_id_6 = RemoteReceiver(int_element_id)
int_element_id_7 = RemoteReceiver(int_element_id)
int_element_id_8 = RemoteReceiver(int_element_id)
int_element_id_9 = RemoteReceiver(int_element_id)
int_element_id_10 = RemoteReceiver(int_element_id)
int_element_id_11 = RemoteReceiver(int_element_id)
int_element_id_12 = RemoteReceiver(int_element_id)
item_27 = ListItem(List=flatten(repeat_3), Index=int_element_id_2, Wrap=True)
item_28 = ListItem(List=flatten(item_26), Index=int_element_id_2, Wrap=True)
item_29 = ListItem(List=flatten(crv_connections_6), Index=int_element_id_2, Wrap=True)
item_30 = ListItem(List=flatten(pln_top_element_start_plane_5), Index=int_element_id_2, Wrap=True)
item_31 = ListItem(List=flatten(orient_2.Geometry), Index=int_element_id_3, Wrap=True)
item_32 = ListItem(List=flatten(orient_3.Geometry), Index=int_element_id_4, Wrap=True)
item_33 = ListItem(List=flatten(orient_4.Geometry), Index=int_element_id_5, Wrap=True)
item_34 = ListItem(List=flatten(orient_5.Geometry), Index=int_element_id_6, Wrap=True)
item_35 = ListItem(List=flatten(orient_6.Geometry), Index=int_element_id_7, Wrap=True)
item_36 = ListItem(List=flatten(orient_7.Geometry), Index=int_element_id_8, Wrap=True)
item_37 = ListItem(List=flatten(orient_8.Geometry), Index=int_element_id_9, Wrap=True)
item_38 = ListItem(List=flatten(orient_9.Geometry), Index=int_element_id_10, Wrap=True)
item_39 = ListItem(List=flatten(orient_10.Geometry), Index=int_element_id_11, Wrap=True)
item_40 = ListItem(List=flatten(orient_11.Geometry), Index=int_element_id_12, Wrap=True)

vec = Vector(orient_10.Geometry)
ln_9 = Line(StartPoint=item_36, EndPoint=item_38)
entwine_4 = Entwine(Branch00=simplify(orient_2.Geometry), Branch01=simplify(orient_3.Geometry), FlattenInputs=True)

neg = Negative(Value=vec)
devec = DeconstructVector(Vector=neg)  # -> XComponent, YComponent, ZComponent
expression_9 = Expression(x=devec.XComponent, z=devec.ZComponent, Expression="(pi / 2) - atan2(z,x)")
Y = UnitY(Factor=1)
rot3d_3 = Rotate3D(Geometry=orient_5.Geometry, Angle=expression_9, Center=Point(0, 0, 0), Axis=Y)  # -> Geometry, Transform
orient_12 = Orient(Geometry=neg, Source=rot3d_3.Geometry, Target=PlaneXY(0, 0, 0))  # -> Geometry, Transform
devec_2 = DeconstructVector(Vector=orient_12.Geometry)  # -> XComponent, YComponent, ZComponent
expression_10 = Expression(y=devec_2.YComponent, z=devec_2.ZComponent, Expression="(pi / 2) - atan2(z,y)")
panel_23 = Panel(expression_10)

# ----
# Show Ideal Connection Vectors
int_element_id_13 = RemoteReceiver(int_element_id)
item_41 = ListItem(List=flatten(orient_7.Geometry), Index=int_element_id_13, Wrap=True)
item_42 = ListItem(List=flatten(orient_9.Geometry), Index=int_element_id_13, Wrap=True)
item_43 = ListItem(List=flatten(orient_8.Geometry), Index=int_element_id_13, Wrap=True)
item_44 = ListItem(List=flatten(vec), Index=int_element_id_13, Wrap=True)
amp_3 = Amplitude(Vector=item_43, Amplitude="0.05")
amp_4 = Amplitude(Vector=item_44, Amplitude="0.05")
neg_2 = Negative(Value=amp_4)
vdis_2 = VectorDisplay(Anchor=item_42, Vector=neg_2)
vdis_3 = VectorDisplay(Anchor=item_41, Vector=amp_3)
vdis_4 = VectorDisplay(Anchor=item_42, Vector=amp_4)

xz = XZPlane(Origin=orient_5.Geometry)
plx = LinePlane(Line=orient_11.Geometry, Plane=xz)  # -> Point, ParamL, ParamP
move_7 = Move(Geometry=plx.Point, Motion=vec)  # -> Geometry, Transform
ln_10 = Line(StartPoint=plx.Point, EndPoint=move_7.Geometry)
plx_2 = LinePlane(Line=ln_10, Plane=orient_5.Geometry)  # -> Point, ParamL, ParamP
ln_11 = Line(StartPoint=plx.Point, EndPoint=plx_2.Point)
project = Project(Geometry=ln_11, Plane=xz)  # -> Geometry, Transform
end_7 = EndPoints(Curve=project.Geometry)  # -> Start, End

pl_origin_2 = PlaneOrigin(Base=rot3d_3.Geometry, Origin=end_7.End)

# ----
# Construct Connector Geometry
line = Line(project.Geometry)
brep = Brep(orient_2.Geometry)
brep_2 = Brep(orient_3.Geometry)
bcx = BrepCurve(Brep=brep, Curve=line)  # -> Curves, Points
bcx_2 = BrepCurve(Brep=brep_2, Curve=line)  # -> Curves, Points
end_8 = EndPoints(Curve=line)  # -> Start, End
item_45 = ListItem(List=bcx.Points, Index=0, Wrap=True)
item_46 = ListItem(List=bcx_2.Points, Index=0, Wrap=True)
trim_3 = TrimTree(Tree=item_45, Depth=1)
trim_4 = TrimTree(Tree=item_46, Depth=1)
division_5 = Division(A="0.045", B="-2")
pl_origin_3 = PlaneOrigin(Base=pl_origin_2, Origin=end_8.Start)
pt_9 = ConstructPoint(XCoordinate=division_5, YCoordinate=division_5, ZCoordinate=0)
pl_origin_4 = PlaneOrigin(Base=orient_5.Geometry, Origin=trim_3)
pl_origin_5 = PlaneOrigin(Base=orient_6.Geometry, Origin=trim_4)
orient_13 = Orient(Geometry=pt_9, Source=PlaneXY(0, 0, 0), Target=pl_origin_3)  # -> Geometry, Transform
pl_origin_6 = PlaneOrigin(Base=pl_origin_3, Origin=orient_13.Geometry)
flatten_2 = FlattenTree(Tree=line, Path="{0}")  # -> graft(Tree)
rectangle_2 = Rectangle(Plane=pl_origin_6, XSize="0.045", YSize="0.045", Radius=0)  # -> Rectangle, Length
flatten_3 = FlattenTree(Tree=rectangle_2.Rectangle, Path="{0}")  # -> graft(Tree)
swp1 = Sweep1(Rail=simplify(flatten_2), Sections=simplify(flatten_3), Miter=1)
unflatten = UnflattenTree(Tree=swp1, Guide=rectangle_2.Rectangle)
plntrimsrf = PlaneTrimSurface(Surface=unflatten, Plane=pl_origin_4, Flip=False)  # -> Trimmed, Intersected
trim_5 = TrimTree(Tree=plntrimsrf.Trimmed, Depth=1)
plntrimsrf_2 = PlaneTrimSurface(Surface=trim_5, Plane=pl_origin_5, Flip=False)  # -> Trimmed, Intersected
cap = CapHoles(Brep=plntrimsrf_2.Trimmed)
trim_6 = TrimTree(Tree=cap, Depth=1)
brep_3 = Brep(trim_6)
brep_connector_geometry = RemoteSender(brep_3)

# ----
# Find Bad Connections
panel_24 = Panel("""255,0,0
0,0,255""")
bool_direction_13 = RemoteReceiver(bool_direction)
brep_connector_geometry_2 = RemoteReceiver(brep_connector_geometry)
mesh_fabrication_mesh_final_5 = RemoteReceiver(mesh_fabrication_mesh_final)
col = Colour(panel_24)
item_47 = ListItem(List=col, Index=bool_direction_13, Wrap=True)
dispatch_16 = Dispatch(List=flatten(mesh_fabrication_mesh_final_5), DispatchPattern=flatten(bool_direction_13))  # -> ListA, ListB
null = NullItem(Item=flatten(brep_connector_geometry_2))  # -> NullFlags, InvalidFlags, Description
lng_8 = ListLength(List=brep_connector_geometry_2)
repeat_4 = RepeatData(Data=graft(dispatch_16.ListA), Length=lng_8)  # -> flatten(Data)
int_3 = Integer(null.NullFlags)
int_4 = Integer("1")
int_connection_mapping_4 = RemoteReceiver(int_connection_mapping)
mindex_7 = MemberIndex(Set=int_3, Member=int_4)  # -> Index, Count
panel_25 = Panel(mindex_7.Index)
item_48 = ListItem(List=dispatch_16.ListB, Index=flatten(int_connection_mapping_4), Wrap=True)
item_49 = ListItem(List=flatten(item_48), Index=mindex_7.Index, Wrap=True)
item_50 = ListItem(List=flatten(repeat_4), Index=mindex_7.Index, Wrap=True)
col_2 = Colour("0,0,255")
col_3 = Colour("255,0,0")
preview_12 = CustomPreview(Geometry=flatten(item_49), Material=flatten(col_3))
preview_13 = CustomPreview(Geometry=flatten(item_50), Material=flatten(col_2))

# ----
# Extract Fabrication Numbers
deg_2 = Degrees(Radians=panel_23)
ln_12 = Line(StartPoint=bcx.Points, EndPoint=bcx_2.Points)
tstat_2 = TreeStatistics(Tree=simplify(deg_2))  # -> Paths, Length, Count
trim_7 = TrimTree(Tree=ln_12, Depth=1)
len_4 = Length(Curve=trim_7)  # -> flatten(Length)
num_connector_centerlines = RemoteSender(trim_7)
dpath = DeconstructPath(Branch=tstat_2.Paths)
int_connection_mapping_5 = RemoteReceiver(int_connection_mapping)
int_5 = Integer(flatten(dpath))
expression_11 = Expression(x=len_4, Expression="x * 1000")
repeat_5 = RepeatData(Data=graft(int_5), Length=graft(tstat_2.Length))  # -> flatten(Data)
deg_3 = Degrees(Radians=expression_9)  # -> flatten(Degrees)
num_21 = Number(flatten(deg_2))
int_6 = Integer(flatten(int_connection_mapping_5))
bnd_4 = Bounds(Numbers=expression_11)
panel_26 = Panel(bnd_4)
element_length_2 = Panel(expression_11)
angle_a_2 = Panel(deg_3)
angle_b_2 = Panel(num_21)
base_ids_2 = Panel(repeat_5)
secondary_ids_2 = Panel(int_6)

brep_connector_geometry_3 = RemoteReceiver(brep_connector_geometry)
null_2 = NullItem(Item=brep_connector_geometry_3)  # -> flatten(NullFlags), InvalidFlags, Description
mindex_8 = MemberIndex(Set=null_2.NullFlags, Member=Toggle(True))  # -> Index, Count
mindex_9 = MemberIndex(Set=null_2.NullFlags, Member=Toggle(False))  # -> Index, Count
neg_3 = Negative(Value=mindex_8.Count)
num_22 = Number(mindex_9.Count)
connectors_goal = RemoteSender(neg_3)

connectors_goal_2 = RemoteReceiver(connectors_goal)
num_23 = Number(connectors_goal_2)
panel_27 = Panel(num_23)

abs = Absolute(Value=deg_3)
abs_2 = Absolute(Value=num_21)
addition_3 = Addition(A=abs, B=abs_2)
num_angle_totals = RemoteSender(addition_3)

flatten_4 = FlattenTree(Tree=brep_3, Path="{0}")
move_8 = Move(Geometry=graft(flatten_4), Motion=graft(flatten))  # -> Geometry, Transform
preview_14 = CustomPreview(Geometry=move_8.Geometry, Material=ColourSwatch(SwatchColor=RGB(120, 92, 62)))

# ----
# Preview Final Geometry
bool_direction_14 = RemoteReceiver(bool_direction)  # disabled
panel_28 = Panel("""255,0,0
0,0,255""")  # disabled
pln_base_element_start_plane_9 = RemoteReceiver(pln_base_element_start_plane)  # disabled
brep_connector_geometry_4 = RemoteReceiver(brep_connector_geometry)  # disabled
item_51 = ListItem(List=panel_28, Index=bool_direction_14, Wrap=True)  # disabled
mesh_fabrication_mesh_final_6 = RemoteReceiver(mesh_fabrication_mesh_final)  # disabled
swatch_6 = ColourSwatch(SwatchColor=RGB(0, 255, 111))  # disabled
swatch_7 = ColourSwatch(SwatchColor=RGB(130, 130, 130))  # disabled
orient_14 = Orient(Geometry=brep_connector_geometry_4, Source=PlaneXY(0, 0, 0), Target=pln_base_element_start_plane_9)  # -> Geometry, Transform; disabled
col_4 = Colour(item_51)  # disabled
srf_4 = Surface(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)  # disabled
preview_15 = CustomPreview(Geometry=flatten(mesh_fabrication_mesh_final_6), Material=flatten(col_4))  # disabled
preview_16 = CustomPreview(Geometry=srf_4, Material=swatch_7)  # disabled
preview_17 = CustomPreview(Geometry=orient_14.Geometry, Material=swatch_6)  # disabled

int_element_id_14 = RemoteReceiver(int_element_id)  # disabled
brep_connector_geometry_5 = RemoteReceiver(brep_connector_geometry)  # disabled
item_52 = ListItem(List=flatten(brep_connector_geometry_5), Index=int_element_id_14, Wrap=True)  # disabled
item_53 = ListItem(List=entwine_4, Index=int_element_id_14, Wrap=True)  # disabled
panel_29 = Panel("0,0,255")  # disabled
col_5 = Colour(panel_29)  # disabled
preview_18 = CustomPreview(Geometry=item_53, Material=ColourSwatch(SwatchColor=RGB(120, 92, 62)))  # disabled
preview_19 = CustomPreview(Geometry=item_52, Material=ColourSwatch(SwatchColor=RGB(0, 255, 4)))  # disabled

int_connection_mapping_6 = RemoteReceiver(int_connection_mapping)
brep_4 = Brep(item_52)
num_angle_totals_2 = RemoteReceiver(num_angle_totals)

# ----
# Preview UV Space
num_connector_centerlines_2 = RemoteReceiver(num_connector_centerlines)
bool_direction_15 = RemoteReceiver(bool_direction)
line_uv_space_design_2 = RemoteReceiver(line_uv_space_design)
panel_30 = Panel("""255,0,0
0,0,255""")
item_54 = ListItem(List=panel_30, Index=bool_direction_15, Wrap=True)
pln_base_element_start_plane_10 = RemoteReceiver(pln_base_element_start_plane)
orient_15 = Orient(Geometry=num_connector_centerlines_2, Source=PlaneXY(0, 0, 0), Target=pln_base_element_start_plane_10)  # -> Geometry, Transform
srf_design_surface_4 = RemoteReceiver(srf_design_surface)
eval_13 = EvaluateCurve(Curve=orient_15.Geometry, Parameter="0.5")  # -> Point, Tangent, Angle
srf_cp_2 = SurfaceClosestPoint(Point=eval_13.Point, Surface=srf_design_surface_4)  # -> Point, UVPoint, Distance
len_5 = Length(Curve=num_connector_centerlines_2)
pt_10 = Point(srf_cp_2.UVPoint)

mpipe = MeshPipe(Polylines=line_uv_space_design_2, NumberOfSides=4, Tolerance=0.1, Radius="0.007", Cap="1", Join=False)
flipm = FlipMesh(Mesh=mpipe, VertexNormals=True, FaceNormals=True, FaceOrientation=True)

preview_20 = CustomPreview(Geometry=flatten(flipm), Material=flatten(item_54))

unflatten_2 = UnflattenTree(Tree=num_angle_totals_2, Guide=len_5)

bnd_5 = Bounds(Numbers=flatten(unflatten_2))
remap = RemapNumbers(Value=unflatten_2, Source=bnd_5, Target="0.001 to 0.05")  # -> Mapped, Clipped
circle = CircleCNR(Center=pt_10, Normal=Vector(0, 0, 1), Radius=remap.Mapped)
srf_5 = Surface(circle)
preview_21 = CustomPreview(Geometry=srf_5, Material=ColourSwatch(SwatchColor=RGB(158, 158, 158)))

pcharge = PointCharge(Point=flatten(pt_10), Charge=flatten(len_5), Decay=Slider(1.103, range=0..5))
mergef = MergeFields(Fields=pcharge)
division_6 = Division(A="1", B="20")
sqgrid_2 = Square(Plane=PlaneXY(0, 0, 0), Size=division_6, ExtentX="20", ExtentY="20")  # -> Cells, Points
area = Area(Geometry=sqgrid_2.Cells)  # -> Area, Centroid
evf = EvaluateField(Field=mergef, Point=area.Centroid)  # -> unitize(simplify(Tensor)), Strength
bnd_6 = Bounds(Numbers=flatten(evf.Strength))
remap_2 = RemapNumbers(Value=evf.Strength, Source=bnd_6, Target="0 to 1")  # -> Mapped, Clipped
devec_3 = DeconstructVector(Vector=evf.Tensor)  # -> XComponent, YComponent, ZComponent
Z = UnitZ(Factor=remap_2.Mapped)
move_9 = Move(Geometry=area.Centroid, Motion=Z)  # -> simplify(Geometry), Transform
bnd_7 = Bounds(Numbers=flatten(devec_3.XComponent))
bnd_8 = Bounds(Numbers=flatten(devec_3.YComponent))
bnd_9 = Bounds(Numbers=flatten(devec_3.ZComponent))
remap_3 = RemapNumbers(Value=devec_3.XComponent, Source=bnd_7, Target="0 to 255")  # -> Mapped, Clipped
remap_4 = RemapNumbers(Value=devec_3.YComponent, Source=bnd_8, Target="0 to 255")  # -> Mapped, Clipped
remap_5 = RemapNumbers(Value=devec_3.ZComponent, Source=bnd_9, Target="0 to 255")  # -> Mapped, Clipped
frompoints = MeshFromPoints(Points=flatten(move_9.Geometry), UDirection="20", VDirection="20")
rgb = ColourRGB(Alpha=255, Red=remap_3.Mapped, Green=remap_4.Mapped, Blue=remap_5.Mapped)  # -> flatten(Colour)
demesh = DeconstructMesh(Mesh=frompoints)  # -> Vertices, Faces, Colours, Normals
conmesh = ConstructMesh(Vertices=demesh.Vertices, Faces=demesh.Faces, Colours=rgb)
mesh_2 = Mesh(conmesh)

# ==== cluster Cluster
Y = ClusterInput()
Z = ClusterInput()
Y_2 = ClusterInput()
Z_2 = ClusterInput()
X = ClusterInput()
Y_3 = ClusterInput()
F = ClusterInput()
F_2 = ClusterInput()
vec = VectorXYZ(XComponent=0, YComponent=Y, ZComponent=Z)  # -> Vector, Length
pt = ConstructPoint(XCoordinate=0, YCoordinate=Y_2, ZCoordinate=Z_2)
pt_2 = ConstructPoint(XCoordinate=X, YCoordinate=Y_3, ZCoordinate=0)
Y_4 = UnitY(Factor=F)
Y_5 = UnitY(Factor=F_2)
bzspan = BezierSpan(StartPoint=pt_2, StartTangent=[Y_4, vec.Vector], EndPoint=pt, EndTangent=Y_5)  # -> Curve, Length, Domain
item = ListItem(List=bzspan.Curve, Index=0, Wrap=True)  # -> Item, Item1
x = ClusterInput()
x_2 = ClusterInput()
x_3 = ClusterInput()
crv = Curve(item.Item1)
neg = Negative(Value=x)
A = ClusterInput()
X_2 = ClusterInput()
neg_2 = Negative(Value=x_2)
neg_3 = Negative(Value=x_3)
rotate = Rotate(Geometry=item.Item, Angle=degrees([neg, A]), Plane=PlaneXY(0, 0, 0))  # -> Geometry, Transform
vec_2 = VectorXYZ(XComponent=[neg_2, X_2], YComponent=neg_3, ZComponent=0)  # -> Vector, Length
x_4 = ClusterInput()
move = Move(Geometry=rotate.Geometry, Motion=vec_2.Vector)  # -> Geometry, Transform
end = EndPoints(Curve=move.Geometry)  # -> Start, End
neg_4 = Negative(Value=x_4)
A_2 = ClusterInput()
rotate_2 = Rotate(Geometry=move.Geometry, Angle=degrees([neg_4, A_2]), Plane=end.End)  # -> Geometry, Transform
item_2 = ListItem(List=rotate_2.Geometry, Index=0, Wrap=True)  # -> Item, Item1
merge = Merge(Data1=item_2.Item, Data2=crv, Data3=item_2.Item1)
loft = Loft(Curves=merge, Options={Adjust=False, Closed=False, LoftEnds=0, LoftSimp=0, LoftType=0, Rebuild=10, Refit=0.01})
srf = Surface(loft)
srf_2 = ClusterOutput(srf)

# ==== cluster Cluster_2
crv = ClusterInput()
crv_2 = Curve(crv)
lng = ListLength(List=crv_2)
B = ClusterInput()
division = Division(A=lng, B=B)
partition = PartitionList(List=crv_2, Size=division)
tstat = TreeStatistics(Tree=partition)  # -> Paths, Length, Count
i = ClusterInput()
item = ListItem(List=tstat.Paths, Index=i, Wrap=True)
branch = TreeBranch(Tree=partition, Path=item, MaintainPaths=True)
crv_3 = Curve(branch)
index = ItemIndex(List=crv_2, Item=crv_3)
int = Integer(index)
crv_4 = ClusterOutput(crv_3)
int_2 = ClusterOutput(int)

# ==== cluster Cluster_3
M = ClusterInput()
demesh = DeconstructMesh(Mesh=M)  # -> Vertices, Faces, Colours, Normals
lng = ListLength(List=demesh.Vertices)
repeat = RepeatData(Data=ColourSwatch(SwatchColor=RGB(184, 184, 184)), Length=lng)
construct = ConstructPointCloud(Points=demesh.Vertices, Colours=repeat)
C = ClusterOutput(construct)

# ==== cluster Cluster_4
L = ClusterInput()
A = ClusterInput()
lng = ListLength(List=L)
division = Division(A=A, B=lng)
multiplication = Multiplication(A=division, B=100)
roundd = RoundToDecimalPlace(NumberX=multiplication, DecimalPlace=2, RoundType=0)  # -> Rounded, Difference
subtraction = Subtraction(A=100, B=roundd.Rounded)
merge = Merge(Data1=roundd.Rounded, Data2=subtraction)
R = ClusterOutput(merge)
