# Grasshopper definition mattersite_demonstrator_fabrication.gh (Grasshopper 1.0.7)
# plug-ins: KUKA|prc - parametric robot control, Telepathy

# ----
# TODO: Estimate wasted wood
# Measure positions of higher curvature or offset
sim_time = Slider(0, range=0..1)
panel = Panel(Slider(9, range=0..9))
int = Integer(panel)
int_part_id = RemoteSender(int)
num_sim = RemoteSender(sim_time)

panel_2 = Panel("""0 to 11
12 to 22
23 to 34
35 to 48
49 to 64
65 to 78
79 to 93
94 to 104
103 to 113
114 to 125""")
int_part_id_2 = RemoteReceiver(int_part_id)
item = ListItem(List=panel_2, Index=int_part_id_2, Wrap=True)

# ---- group: Design
num = Number([-16.56867893, -4.175028862, -2.091697023, 3.144048605, -8.489401059, 19.78973306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])
num_2 = Number([-8.264400533, 0.5569149769, 6.260595236, -2.621854871, -12.51024698, 15.49237771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])
num_3 = Number([19.88643032, 39.8050472, 54.70678369, 102.085541, 73.09186438, 66.70844372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])
num_4 = Number([0, 0, 0, 1, 1, 1, 2, 2, 2, 3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])
num_5 = Number([0, 1, 3, 0, 1, 9, 2, 3, 5, 0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])
angle_a = Panel(num)
base_ids = Panel(num_4)
secondary_ids = Panel(num_5)
element_length = Panel(num_3)
angle_b = Panel(num_2)
panel_3 = Panel(item)
subset = SubList(List=element_length, Domain=panel_3, Wrap=True)  # -> List, Index
subset_2 = SubList(List=angle_a, Domain=panel_3, Wrap=True)  # -> List, Index
subset_3 = SubList(List=angle_b, Domain=panel_3, Wrap=True)  # -> List, Index
subset_4 = SubList(List=base_ids, Domain=panel_3, Wrap=True)  # -> List, Index
subset_5 = SubList(List=secondary_ids, Domain=panel_3, Wrap=True)  # -> List, Index

# ----
panel_4 = Panel("""-30
-20
-10
10
20
30""")
str_domain = RemoteSender(panel_3)
num_6 = Number(subset_3.List)
expression = Expression(b=num_6, Expression="b / abs(b)")
panel_5 = Panel("""1145
1286
1114
1123
1182
1184
1286
1000
1016
1174""")
int_part_id_3 = RemoteReceiver(int_part_id)
multiplication = Multiplication(A=subset_2.List, B=expression)
multiplication_2 = Multiplication(A=num_6, B=expression)
item_2 = ListItem(List=panel_5, Index=int_part_id_3, Wrap=True)

panel_6 = Panel(multiplication)
panel_7 = Panel(multiplication_2)
panel_8 = Panel(item_2)
panel_9 = Panel(subset.List)
num_stick_length = Number(panel_8)
num_stick_length_raw = RemoteSender(num_stick_length)
rad = Radians(Degrees=panel_6)
rad_2 = Radians(Degrees=panel_7)
# right side (closest edge) is 30 cm from edge of table
pln_saw = Plane(Plane(origin=(-213.3990542, -200.0001605, 238.2029024), x=(0, -1, 0), y=(0.7071067812, 0, 0.7071067812)))
num_half_kerf = RemoteSender("1.5")
num_angle_a = Number(rad)
num_angle_b = Number(rad_2)
pln_saw_2 = RemoteSender(pln_saw)

num_gripper_width = RemoteSender("218")
sl_g = Expression(sl=num_stick_length, gw=num_gripper_width, Expression="sl - (gw / 2)")
num_stick_length_2 = RemoteSender(sl_g)
num_length = Number(panel_9)
num_half_kerf_2 = RemoteReceiver(num_half_kerf)
expression_2 = Expression(
    l=num_length,
    a=num_angle_a,
    b=num_angle_b,
    k=num_half_kerf_2,
    Expression="l + abs(sin(a) * 22.5 / cos(a)) + abs(sin(b) * 22.5 / cos(b))")
expression_3 = Expression(
    l=num_length,
    a=num_angle_a,
    b=num_angle_b,
    k=num_half_kerf_2,
    Expression="l + abs(sin(a) * 22.5 / cos(a)) + abs(sin(b) * 22.5 / cos(b)) + (k * 3)")
num_half_kerf_3 = RemoteReceiver(num_half_kerf)
expression_4 = Expression(a=num_angle_a, k=num_half_kerf_3, Expression="abs(sin(a) * 22.5 / cos(a)) - k")
panel_10 = Panel(expression_2)

shift = ShiftList(List=expression_3, Shift="-1", Wrap=True)
replace = ReplaceItems(List=shift, Item="0", Indices="0", Wrap=False)

pt = ConstructPoint(XCoordinate="-3", YCoordinate=0, ZCoordinate=0)
ma = MassAddition(Input=replace)  # -> Result, PartialResults
num_half_kerf_4 = RemoteReceiver(num_half_kerf)
addition = Addition(A=ma.PartialResults, B=expression_4)

panel_11 = Panel(expression_3)
panel_12 = Panel("""?
90
105
120
125
150""")
panel_13 = Panel("""?
80
95
110
125
140""")

addition_2 = Addition(A=addition, B=num_length, C=num_half_kerf_4, D=num_half_kerf_4)
yz = YZPlane(Origin=pt)
pi = Pi(Factor="0")
yz_2 = YZPlane(Origin=Point(0, 0, 0))

num_stick_length_3 = RemoteReceiver(num_stick_length_2)
subtraction = Subtraction(A=num_stick_length_3, B=addition_2)
neg = Negative(Value=subtraction)

num_stick_length_4 = RemoteReceiver(num_stick_length_2)
subtraction_2 = Subtraction(A=num_stick_length_4, B=addition)
neg_2 = Negative(Value=subtraction_2)

# ---- group: Cut A
vec = VectorXYZ(XComponent=neg_2, YComponent=0, ZComponent=0)  # -> Vector, Length
neg_3 = Negative(Value=num_angle_a)
pln_saw_3 = RemoteReceiver(pln_saw_2)
orient = Orient(Geometry=vec.Vector, Source=PlaneXY(0, 0, 0), Target=pln_saw_3)  # -> Geometry, Transform
pl_origin = PlaneOrigin(Base=pln_saw_3, Origin=orient.Geometry)
Z = UnitZ(Factor="200")
rotate = Rotate(Geometry=pl_origin, Angle=neg_3, Plane=pln_saw_3)  # -> Geometry, Transform
move = Move(Geometry=rotate.Geometry, Motion=Z)  # -> Geometry, Transform
ptp_move = PTPMovementKUKAPrc(TargetAsPlane=move.Geometry, Speed="100", ExternalAxis1="0", extaxenabled=True, interpolation="C_PTP")
lin_move = LINearMovementKUKAPrc(TargetAsPlane=rotate.Geometry, Speed="0.20", extaxenabled=False, interpolation="C_DIS")
lin_move_2 = LINearMovementKUKAPrc(TargetAsPlane=move.Geometry, Speed="0.45", extaxenabled=False, interpolation="C_DIS")
merge = Merge(Data1=graft(ptp_move), Data2=graft(lin_move), Data3=graft(lin_move_2))  # -> simplify(Result)

# ---- group: View Arcs
pi_2 = Pi(Factor=1)
pln_saw_4 = RemoteReceiver(pln_saw_2)
addition_3 = Addition(A=pi_2, B=neg_3)
xz = XZPlane(Origin=Point(0, 0, 0))
neg_4 = Negative(Value=num_angle_b)
pln_saw_5 = RemoteReceiver(pln_saw_2)
neg_5 = Negative(Value=neg_2)
dom = ConstructDomain(DomainStart=pi_2, DomainEnd=addition_3)
orient_2 = Orient(Geometry=xz, Source=PlaneXY(0, 0, 0), Target=pln_saw_4)  # -> Geometry, Transform
dom_2 = ConstructDomain(DomainStart="0", DomainEnd=neg_4)
arc = Arc(Plane=pln_saw_5, Radius=neg_5, Angle=dom)  # -> Arc, Length
arc_2 = Arc(Plane=orient_2.Geometry, Radius=neg, Angle=dom_2)  # -> Arc, Length

# ---- group: Cut B
pln_saw_6 = RemoteReceiver(pln_saw_2)
vec_2 = VectorXYZ(XComponent=neg, YComponent=0, ZComponent=0)  # -> Vector, Length
orient_3 = Orient(Geometry=vec_2.Vector, Source=PlaneXY(0, 0, 0), Target=pln_saw_6)  # -> Geometry, Transform
pl_origin_2 = PlaneOrigin(Base=pln_saw_6, Origin=orient_3.Geometry)
deplane = DeconstructPlane(Plane=pln_saw_6)  # -> Origin, XAxis, YAxis, ZAxis
rot3d = Rotate3D(Geometry=pl_origin_2, Angle=num_angle_b, Center=deplane.Origin, Axis=deplane.YAxis)  # -> Geometry, Transform
Z_2 = UnitZ(Factor="200")
move_2 = Move(Geometry=rot3d.Geometry, Motion=Z_2)  # -> Geometry, Transform
ptp_move_2 = PTPMovementKUKAPrc(TargetAsPlane=move_2.Geometry, Speed="100", ExternalAxis1="0", extaxenabled=True, interpolation="C_PTP")
lin_move_3 = LINearMovementKUKAPrc(TargetAsPlane=rot3d.Geometry, Speed="0.20", extaxenabled=False, interpolation="C_DIS")
lin_move_4 = LINearMovementKUKAPrc(TargetAsPlane=move_2.Geometry, Speed="0.45", extaxenabled=False, interpolation="C_DIS")
merge_2 = Merge(Data1=graft(ptp_move_2), Data2=graft(lin_move_3), Data3=graft(lin_move_4))  # -> simplify(Result)

# ----
int_part_id_4 = RemoteReceiver(int_part_id)
multiplication_3 = Multiplication(A=int_part_id_4, B="-150")
Y = UnitY(Factor=multiplication_3)
str_domain_2 = RemoteReceiver(str_domain)
ins = InsertItems(List=merge, Item=merge_2, Indices="-1", Wrap=True)
dedomain = DeconstructDomain(Domain=str_domain_2)  # -> Start, End
expression_5 = Expression(s=dedomain.Start, e=dedomain.End, Expression="e-s")
range = Range(Domain=expression_5, Steps=expression_5)
int_2 = Integer(range)
format = Format(Format="; FOLD ELEMENT {0} / {1}", Culture=127, Data0=int_2, Data1=expression_5)
krl_code = KRLCodeKUKAPrc(KRLAsText=format)  # -> graft(KUKAPrcCommand)
krl_code_2 = KRLCodeKUKAPrc(KRLAsText=";ENDFOLD")
ins_2 = InsertItems(List=ins, Item=krl_code, Indices="0", Wrap=True)
ins_3 = InsertItems(List=ins_2, Item=krl_code_2, Indices="-1", Wrap=True)

# ---- group: Create Full Sized Stick Model
num_stick_length_raw_2 = RemoteReceiver(num_stick_length_raw)
num_gripper_width_2 = RemoteReceiver(num_gripper_width)
expression_6 = Expression(sl=num_stick_length_raw_2, gw=num_gripper_width_2, Expression="- ((sl / 2) - (gw / 2))")
division = Division(A=num_stick_length_raw_2, B="2")
pt_2 = ConstructPoint(XCoordinate=0, YCoordinate=expression_6, ZCoordinate="217")
box = CenterBox(Base=pt_2, X="22.5", Y=division, Z="22.5")

# ---- group: Turn Table Data
mesh = Mesh([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])
item_3 = ListItem(List=mesh, Index=0, Wrap=True)  # -> Item, Item1
mesh_2 = Mesh(<mesh referenced from the Rhino model>)
mesh_3 = Mesh(<mesh referenced from the Rhino model>)
merge_3 = Merge(Data1=mesh_2, Data2=mesh_3, Data3=item_3.Item)
kr150_240_l110_180 = KR1502402L110180Robot(infiniterot=False)
mjoin = MeshJoin(Meshes=merge_3)
custom_tt = CustomTurntableKUKAPrc(
    KUKAPrcRobotInput=kr150_240_l110_180,
    RotationAxis=Vector(0, 0, 1),
    RotaryAxisBase=mjoin,
    RotaryAxisTurntable=item_3.Item1,
    root_aval="0.0",
    root_bval="0.0",
    root_cval="0.0",
    root_xval="2500",
    root_yval="0.0",
    root_zval="650")

# ---- group: CLOSE GRIPPER
mesh_4 = Mesh(<mesh referenced from the Rhino model>)
mesh_5 = Mesh(box)
mjoin_2 = MeshJoin(Meshes=[mesh_5, mesh_4])
pln = Plane(Plane(origin=(0, 0, 242.550079), x=(0, -1, 0), y=(-1, 0, 0)))
custom_tool_pln = CustomToolPlaneKUKAPrc(ToolGeometry=mjoin_2, ToolNumber="16", ToolPlane=pln, frameinput=False)
tool_closed = RemoteSender(custom_tool_pln)

# ---- group: Command Group for Closing the Gripper
tool_closed_2 = RemoteReceiver(tool_closed)
digital_out = DigitalOutputKUKAPrc(DigitalOutputNumber="18", OutputState="FALSE", ContinuousMovement=False, ToolState=-1)
digital_out_2 = DigitalOutputKUKAPrc(DigitalOutputNumber="17", OutputState="TRUE", ContinuousMovement=False, ToolState=-1)
change_tool = ChangeToolKUKAPrc(KUKAPrcTool=tool_closed_2)
wait = WaitKUKAPrc(KUKAPrcWait="0.25")
wait_2 = WaitKUKAPrc(KUKAPrcWait="0.25")
merge_4 = Merge(Data1=digital_out, Data2=wait, Data3=digital_out_2, Data4=wait_2, Data5=change_tool)
command_gripper_close = RemoteSender(merge_4)

# ---- group: OPEN GRIPPER
mesh_6 = Mesh(<mesh referenced from the Rhino model>)
pln_2 = Plane(Plane(origin=(0, 0, 242.550079), x=(0, -1, 0), y=(-1, 0, 0)))
custom_tool_pln_2 = CustomToolPlaneKUKAPrc(ToolGeometry=mesh_6, ToolNumber="16", ToolPlane=pln_2, frameinput=False)
tool_open = RemoteSender(custom_tool_pln_2)

# ---- group: Command Group for Opening the Gripper
tool_open_2 = RemoteReceiver(tool_open)
digital_out_3 = DigitalOutputKUKAPrc(DigitalOutputNumber="17", OutputState="FALSE", ContinuousMovement=False, ToolState=-1)
digital_out_4 = DigitalOutputKUKAPrc(DigitalOutputNumber="18", OutputState="TRUE", ContinuousMovement=False, ToolState=-1)
change_tool_2 = ChangeToolKUKAPrc(KUKAPrcTool=tool_open_2)
wait_3 = WaitKUKAPrc(KUKAPrcWait="0.25")
wait_4 = WaitKUKAPrc(KUKAPrcWait="0.25")
merge_5 = Merge(Data1=digital_out_3, Data2=wait_3, Data3=digital_out_4, Data4=wait_4, Data5=change_tool_2)
command_gripper_open = RemoteSender(merge_5)

# ---- group: Pickup
expression_7 = Expression(Expression="- (300 - (216 / 2))")
expression_8 = Expression(Expression="-(45 / 2)")
pln_pickup_raw = Plane(PlaneXY(-299.9850226, 500, 0))
vec_3 = VectorXYZ(XComponent=expression_7, YComponent=expression_8, ZComponent=0)  # -> Vector, Length
move_3 = Move(Geometry=pln_pickup_raw, Motion=vec_3.Vector)  # -> Geometry, Transform
Z_3 = UnitZ(Factor="200")
move_4 = Move(Geometry=move_3.Geometry, Motion=Z_3)  # -> Geometry, Transform
ptp_move_3 = PTPMovementKUKAPrc(TargetAsPlane=move_4.Geometry, Speed="100", ExternalAxis1="0", extaxenabled=True, interpolation="C_PTP")
command_gripper_open_2 = RemoteReceiver(command_gripper_open)
command_gripper_close_2 = RemoteReceiver(command_gripper_close)
lin_move_5 = LINearMovementKUKAPrc(TargetAsPlane=move_3.Geometry, extaxenabled=False, interpolation="C_DIS")
lin_move_6 = LINearMovementKUKAPrc(TargetAsPlane=move_4.Geometry, extaxenabled=False, interpolation="C_DIS")
merge_6 = Merge(Data1=ptp_move_3, Data2=command_gripper_open_2, Data3=lin_move_5, Data4=command_gripper_close_2, Data5=lin_move_6)

# ----
ins_4 = InsertItems(List=flatten(ins_3), Item=merge_6, Indices="0", Wrap=True)

# ----
# Existing Tool 16 Was :
# 'gripper short'
# -5,0,242.15,0,-90,0
int_part_id_5 = RemoteReceiver(int_part_id)
merge_7 = Merge(Data1="rcbe_batch", Data2="_", Data3=int_part_id_5)
save_program = Button()
kuka_command = KUKAPrcCommand(flatten(ins_4))
# ROBOT SETUP
num_sim_2 = RemoteReceiver(num_sim)
join = TextJoin(Text=merge_7)
panel_14 = Panel(join)
kuka_prc = KUKAPrcCORE(
    SimulationSlider=num_sim_2,
    KUKAPrcCommands=kuka_command,
    Tool=tool_open,
    Robot=custom_tt,
    SaveToggle=save_program,
    Filename=panel_14,
    PRC_BaseExpose=False,
    PRC_SaveNameExpose=True,
    PRCsettings="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")  # -> RobotGeometry, AnalysisOutput
magic_sauce_for_external_turntable = Panel("""$BASE=EK(BASE_DATA[3],#EASYS,{X 0,Y 0,Z 0,A 0,B 0,C 0})
$ACT_EX_AX=2""")
analysis = AnalysisKUKAPrc(KUKAPrcAnalysisData=kuka_prc.AnalysisOutput)  # -> RobotAxisValues, RobotCollisionCheck, RobotReachabilityCheck, CommandID, TimeValue, Planes, CommandTags, IOState, Index, KRL
ma_2 = MassAddition(Input=flatten(analysis.RobotCollisionCheck))  # -> Result, PartialResults
ma_3 = MassAddition(Input=flatten(analysis.RobotReachabilityCheck))  # -> Result, PartialResults
collision = Panel(ma_2.Result)
reachability = Panel(ma_3.Result)

# ---- group: Create Full Sized Stick Model
num_stick_length_raw_3 = RemoteReceiver(num_stick_length_raw)

# ----
addition_4 = Addition(A=num_stick_length_raw_3, B="3.1")

num_stick_length_raw_4 = RemoteReceiver(num_stick_length_raw)
pt_3 = ConstructPoint(XCoordinate=num_stick_length_raw_4, YCoordinate=0, ZCoordinate=0)
yz_3 = YZPlane(Origin=pt_3)
pi_3 = Pi(Factor="-0.5")
yz_4 = YZPlane(Origin=Point(0, 0, 0))

# ---- group: Create Full Sized Stick Model (continued)
division_2 = Division(A=addition_4, B="2")

# ----
subtraction_3 = Subtraction(A=division_2, B="3.1")

# ---- group: Create Full Sized Stick Model (continued)
pt_4 = ConstructPoint(XCoordinate=subtraction_3, YCoordinate=0, ZCoordinate=0)
box_2 = CenterBox(Base=pt_4, X=division_2, Y="22.5", Z="22.5")

# ---- group: Visualize Planes
pt_5 = ConstructPoint(XCoordinate=addition_2, YCoordinate=0, ZCoordinate=0)
pt_6 = ConstructPoint(XCoordinate=addition, YCoordinate=0, ZCoordinate=0)
pt_7 = ConstructPoint(XCoordinate=ma.PartialResults, YCoordinate=0, ZCoordinate=0)
num_stick_length_raw_5 = RemoteReceiver(num_stick_length_raw)
yz_5 = YZPlane(Origin=pt_5)
yz_6 = YZPlane(Origin=pt_6)
yz_7 = YZPlane(Origin=pt_7)
xz_2 = XZPlane(Origin=yz_6)
subtraction_4 = Subtraction(A=num_stick_length_raw_5, B="300")
xy = XYPlane(Origin=yz_5)
rotate_2 = Rotate(Geometry=yz_6, Angle=num_angle_a, Plane=xz_2)  # -> Geometry, Transform
rotate_3 = Rotate(Geometry=yz_5, Angle=num_angle_b, Plane=xy)  # -> Geometry, Transform
pt_8 = ConstructPoint(XCoordinate=subtraction_4, YCoordinate=0, ZCoordinate=0)
sec = BrepPlane(Brep=box_2, Plane=rotate_3.Geometry)  # -> Curves, Points
sec_2 = BrepPlane(Brep=box_2, Plane=rotate_2.Geometry)  # -> Curves, Points
sec_3 = BrepPlane(Brep=box_2, Plane=yz_7)  # -> Curves, Points
yz_8 = YZPlane(Origin=pt_8)
srf = Surface(sec_3.Curves)
srf_2 = Surface(sec_2.Curves)
srf_3 = Surface(sec.Curves)

# ----
sec_4 = BrepPlane(Brep=box_2, Plane=yz)  # -> Curves, Points

sec_5 = BrepPlane(Brep=box_2, Plane=yz_3)  # -> Curves, Points
rotate_4 = Rotate(Geometry=sec_5.Curves, Angle=pi_3, Plane=yz_4)  # -> Geometry, Transform

rotate_5 = Rotate(Geometry=sec_4.Curves, Angle=pi, Plane=yz_2)  # -> Geometry, Transform
shift_2 = ShiftList(List=flatten(sec.Curves), Shift="-1", Wrap=True)  # -> graft(List)

item_4 = ListItem(List=flatten(sec_2.Curves), Index="0", Wrap=True)
merge_8 = Merge(Data1=item_4, Data2=rotate_5.Geometry)  # -> flatten(Result)
loft = Loft(Curves=merge_8, Options={Adjust=False, Closed=False, LoftEnds=0, LoftSimp=0, LoftType=0, Rebuild=10, Refit=0.01})
cap = CapHoles(Brep=loft)

merge_9 = Merge(Data1=simplify(sec_2.Curves), Data2=simplify(shift_2))
loft_2 = Loft(Curves=merge_9, Options={Adjust=False, Closed=False, LoftEnds=0, LoftSimp=0, LoftType=0, Rebuild=10, Refit=0.01})  # -> flatten(Loft)
split = SplitList(List=loft_2, Index="1")  # -> ListA, ListB
cap_2 = CapHoles(Brep=split.ListB)
merge_10 = Merge(Data1=cap_2, Data2=cap)  # -> flatten(Result)
mesh_7 = Mesh(merge_10)
mcol = MeshColours(Mesh=mesh_7, Colours=ColourSwatch(SwatchColor=RGB(255, 187, 0)))

merge_11 = Merge(Data1=simplify(sec_2.Curves), Data2=simplify(sec.Curves))
loft_3 = Loft(Curves=merge_11, Options={Adjust=False, Closed=False, LoftEnds=0, LoftSimp=0, LoftType=0, Rebuild=10, Refit=0.01})  # -> flatten(Loft)
cap_3 = CapHoles(Brep=loft_3)
mesh_8 = Mesh(cap_3)
mcol_2 = MeshColours(Mesh=mesh_8, Colours=ColourSwatch(SwatchColor=RGB(120, 92, 62)))

brep = Brep(box_2)
volume = Volume(Geometry=brep)  # -> Volume, Centroid
volume_2 = Volume(Geometry=merge_10)  # -> Volume, Centroid
volume_3 = Volume(Geometry=cap_3)  # -> Volume, Centroid
ma_4 = MassAddition(Input=volume_2.Volume)  # -> Result, PartialResults
ma_5 = MassAddition(Input=volume_3.Volume)  # -> Result, PartialResults
int_3 = Integer(ma_5.Result)
panel_15 = Panel(int_3)
panel_16 = Panel(ma_4.Result)
rec = DataRecorder(panel_15, DataLimit=-10, RecordData=True)
rec_2 = DataRecorder(panel_16, DataLimit=-10, RecordData=True)
int_4 = Integer(volume.Volume)
rec_3 = DataRecorder(int_4, DataLimit=-10, RecordData=True)
panel_17 = Panel(int_4)
int_5 = Integer(rec)
int_6 = Integer(rec_2)
int_7 = Integer(rec_3)
panel_18 = Panel(int_5)
panel_19 = Panel(int_6)
panel_20 = Panel(int_7)

item_5 = ListItem(List=flatten(sec.Curves), Index="-1", Wrap=True)
merge_12 = Merge(Data1=item_5, Data2=rotate_4.Geometry)  # -> flatten(Result)
loft_4 = Loft(Curves=merge_12, Options={Adjust=False, Closed=False, LoftEnds=0, LoftSimp=0, LoftType=0, Rebuild=10, Refit=0.01})

cap_4 = CapHoles(Brep=loft_4)

mesh_9 = Mesh(cap_4)
mcol_3 = MeshColours(Mesh=mesh_9, Colours=ColourSwatch(SwatchColor=RGB(176, 169, 162)))

volume_4 = Volume(Geometry=cap_4)  # -> Volume, Centroid
panel_21 = Panel(volume_4.Volume)
merge_13 = Merge(Data1=mcol_2, Data2=mcol, Data3=mcol_3)
group = Group(Objects=merge_13)
move_5 = Move(Geometry=group, Motion=Y)  # -> Geometry, Transform
rec_4 = DataRecorder(panel_21, DataLimit=-10, RecordData=True)
rec_5 = DataRecorder(move_5.Geometry, DataLimit=-10, RecordData=True)
grp = Group(rec_5)
ungroup = Ungroup(Group=grp)
int_8 = Integer(rec_4)
mesh_10 = Mesh(ungroup)
panel_22 = Panel(int_8)
